vi "AWGN generation.gvi"   [LabVIEW Communications System Design Software 2.0.1]
inputs:
  "Waveform in": cluster{"t0": f64, "dt": f64, "Y": c128[]} = {"t0"=0, "dt"=1, "Y"=[]}
  "symbol rate": f64 = 10000
  "eb/n0 [dB of complex]": f64 = 10
  "Error In": error
outputs:
  "Error Out": error
  "Waveform out": cluster{"t0": f64, "dt": f64, "Y": c128[]}
diagram:
  case ($"Error In") {
    frame Error {
      w1 = $"Waveform in"
      w2 = $"Error In"
    }
    frame No Error {
      Property Node(instance in=$"Waveform in") -> ("Y"=w3, "dt"=w4)
      # dB to lin
      Divide(x=$"eb/n0 [dB of complex]", y=10) -> w5
      Power Of 10(x=w5) -> w6
      w7 = 2  # M(PSK)
      Logarithm Base 2(x=w7) -> w8
      Multiply(w6, w8) -> w9
      # Es/N0 = Eb/Na*log_{2}M
      # Es/N0 = (C/N)*(B/fs)
      #
      # Es/N0 = energy per symbol
      # C/N = Carrier of Signal to noise ratio
      # B = Channel BW
      # Fs = Symbol per second
      Reciprocal(x=w4) -> w10
      Divide(x=w9, y=w10) -> w11
      # multiply by to as WFM is complex
      Multiply($"symbol rate", w11) -> w12
      Multiply(w12, 2) -> w13
      Array Size(array=w3) -> (size(s)=w14)
      for {
        w15 = each element of w3
        Absolute Value(x=w15) -> w17
        Square(x=w17) -> w18
        append w18 to w16
      }
      Add Array Elements(numeric array=w16) -> (sum=w19)
      # E = power of signal
      # w20: E
      Divide(x=w19, y=w14) -> w20
      Divide(x=w20, y=w13) -> w21
      Square Root(x=w21) -> w22
      for (N = w14) {
        Random Number() -> (number (0 to 1)=w24)
        append w24 to w23
      }
      Multiply(w23, 2) -> w25
      Subtract(x=w25, y=1) -> w26
      # w22: Noise variance
      Multiply(w22, w26) -> w27
      # Generate random numbers between -1 and 1
      for (N = w14) {
        Random Number() -> (number (0 to 1)=w29)
        append w29 to w28
      }
      Multiply(2, w28) -> w30
      Subtract(x=w30, y=1) -> w31
      # Multiply random numbers with Noise
      Multiply(w22, w31) -> w32
      # Add noise to signal
      Real And Imaginary To Complex(x=w27, y=w32) -> w33
      Add(w3, w33) -> w34
      Property Node(instance in=$"Waveform in", "Y"=w34) -> (instance out=w1)
      w2 = $"Error In"
    }
  }
  $"Waveform out" <- w1
  $"Error Out" <- w2
