vi "BER.gvi"   [LabVIEW Communications System Design Software 2.0.1]
inputs:
  "Number of averages": i32 = 1
  "Reference bits": i8[]
  "Input bits": i8[][]
  "error in": error
outputs:
  "Averaged BER": f64
  "error out": error
diagram:
  # 1. Not equal function checks bit by bit if equal or not. Number of not equals are summed and it's result is divided by the number of bits
  # 2. Generates a windowed average of the last "N" BER calculations
  # 3. If there is no data coming in, BER == 1
  case ($"error in") {
    frame No Error, Default {
      s1 = uninitialised  # shift register
      for {
        w3 = each element of $"Input bits"
        # ----------------1---------------
        Array Size(array=$"Reference bits") -> (size(s)=w4)
        Is Not Equal(x=w3, y=$"Reference bits") -> w5
        Boolean To Integer(Boolean=w5) -> (0, 1=w6)
        To Unsigned Long Integer(number=w6) -> w7
        Add Array Elements(numeric array=w7) -> (sum=w8)
        Divide(x=w8, y=w4) -> w9
        Build Array[ConcatenateInputs=True](w9, s1) -> w10
        Delete From Array(inArray=w10, length (1)=$"Number of averages", index0=0) -> (deleted=w11)
        # ----------------2---------------
        Add Array Elements(numeric array=w11) -> (sum=w12)
        Divide(x=w12, y=$"Number of averages") -> w13
        next s1 = w11
      }
      Array Index(array=$"Input bits") -> (out0[_, _]=w14)
      Array Size(array=w14) -> (size(s)=w15)
      Is Not Equal To 0(x=w15) -> w16
      # ---3---
      Select(s=w16, t=w13, f=1) -> w2
      w1 = $"error in"
    }
    frame Error {
      w1 = $"error in"
      w2 = NaN
    }
  }
  $"Averaged BER" <- w2
  $"error out" <- w1
