vi "Main (Simulation)_v01.gvi"   [LabVIEW Communications System Design Software 2.0.1]
# This VI calculates waveform’s V^2(RMS) to use it to notmalize it’s amllitude to 1
panel controls:
  "Project Parameters": i32 = 2
  "Eb/N0 (SNR) [dB]": f64 = 11.2676056338
  "stop": bool
  "symbol rate (baud)": f64 = 10000
  "Block selection": T1 = "Raw data+CRC+Coding+Modulation"
  "Data Measurements": i32
  "Reinitialize": bool
  "Filter": "Filter.gtype" = {"Transmit filter"="Root Raised Cos", "Pulse filter parameter"=0.5, "Receive filter"="Root Raised Cos", "Matched filter parameter"=0.5}
  "samples per symbol": i32 = 16
  "Rate (k/n)": enum{"1/2", "none"} = "1/2"
  "# Message Symbols": i32 = 1000
  "# Guard Symbols": i32 = 80
panel indicators:
  "CRC result": u16
  "BER": f64
  "# Recieved bits": i32
  "Constellation Graph": T2[]
  "CRC LED": bool
  "Code LED": bool
  "Data LED": bool
  "Mod LED": bool
  "Eye Diagram": cluster{"t0": f64, "dt": f64, "Y": f64[]}[]
  "Power Spectrum": T3
  "Sync LED": bool
  "# Sent bits": i32
  "Eb/N0 [dB] (num)": f64
  "Sync Error": bool
  "Matched filter coefficients": f64[]
  "Pulse shaping filter coefficients": f64[]
  "Channel Est LED": bool
  "Error Out": error
  "Trellis": cluster{"t0": f64, "dt": f64, "phase": f64[]}[]
  "Time": i8[][]
  "Averaged BER": f64
  "Averaged BLER": f64
types:
  T1 = enum{"Raw data", "Raw data+CRC", "Raw data+CRC+Coding", "Raw data+CRC+Coding+Modulation"}
  T2 = cluster{"constellation": f64[], "oversampled data": f64[]}
  T3 = cluster{"f0": f64, "df": f64, "magnitude": f64[]}
  T4 = enum{"none", "Raised Cosine", "Root Raised Cos", "Gaussian"}
  "Filter.gtype" = cluster{"Transmit filter": T4, "Pulse filter parameter": f64, "Receive filter": T4, "Matched filter parameter": f64}
  T5 = cluster{"samples per symbol": i32, "M-PSK": i32, "differential PSK": enum{"disable", "enable"}, "PSK type": enum{"normal", "shifted", "offset"}}
  "Burst Parameters.gtype" = cluster{"# Message Symbols": i32, "# Guard Symbols": i32, "Sync Bits": u16}
  "Coding and CRC.gtype" = cluster{"Rate (k/n)": enum{"1/2", "none"}, "CRC seed": u16}
  T6 = enum{"Eye Diagram", "Constellation Graph", "Spectrum", "BER", "Trellis"}
  T7 = enum{"No averaging", "Vector averaging", "RMS averaging", "Peak hold"}
  "Averaging Parameters.gtype" = cluster{"averaging mode": T7, "weighting mode": enum{"Linear", "Exponential"}, "number of averages": u32}
uses:
  NI::Analysis::Measurement::Power Spectrum for 1 Chan (CDB).gvi
diagram:
  while {
    w1 = T5 {"samples per symbol"=16, "M-PSK"=2, "differential PSK"="enable", "PSK type"="normal"}
    Property Node(instance in=w1, "samples per symbol"=$"samples per symbol") -> ("samples per symbol"=w2, "M-PSK"=w3, instance out=w4)
    w5 = "Burst Parameters.gtype" {"# Message Symbols"=1000, "# Guard Symbols"=80, "Sync Bits"=64250}
    Property Node(instance in=w5, "# Message Symbols"=$"# Message Symbols", "# Guard Symbols"=$"# Guard Symbols") -> (instance out=w6)
    w7 = "Coding and CRC.gtype" {"Rate (k/n)"="1/2", "CRC seed"=56797}
    Property Node(instance in=w7, "Rate (k/n)"=$"Rate (k/n)") -> (instance out=w8)
    call "Modulation init.gvi"(PSK Parameters=w4, Filter=$Filter, Burst Parameters=w6, Coding and CRC=w8) -> (Demodulation parameters=w9, Modulation parameters=w10, error out=w11)
    Property Node(instance in=w9) -> ("pulse shaping filter coefficients"=w12, "matched filter coefficients"=w13)
    $"Pulse shaping filter coefficients" <- w12
    $"Matched filter coefficients" <- w13
    w14 = $"symbol rate (baud)"
    # 1.
    w15 = $"Block selection"
    To Double Precision Float(number=w3) -> w16
    Logarithm Base 2(x=w16) -> w17
    To Long Integer(number=w17) -> w18
    # 2.
    # 3.
    # 4.
    # 7.
    # 8.
    # 1. Initializing the modulation. (Mod type, Filters, sync parameters)
    # 2. Generating data. (Burst generation, coding, modulation,...)
    # 3. Add AWGN noise to output waveform for simulation.
    # 4. Recieving data. (Demodulation, decoding, processing...)
    # 5. Handling the indicators on the user interface.
    # 6. Processing the measurement selected by the Data Measurement tab. (In this case only the displayed measurement will be processed for saving processor resources.
    # 7. The While loop stops if Stop button is pressed or error occured.
    while {
      Wait(time to wait=200)
      call "Tx data processing.gvi"(error in=w11, Block selection=w15, Modulation parameters=w10, symbol rate (baud)=w14) -> (Data=w19, Output Bit Stream=w20, error out=w21)
      Property Node(instance in=w19) -> ("Modulated Waveform"=w22, instance out=w23)
      call "MT Add AWGN.gvi"(input complex waveform=w22, samples per symbol=w2, bits per symbol=w18, eb/n0=$"Eb/N0 (SNR) [dB]", error in=w21) -> (output complex waveform=w24, error out=w25)
      Property Node(instance in=w23, "Modulated Waveform"=w24) -> (instance out=w26)
      call "Rx data processing.gvi"(Data=w26, Demodulation paremeters=w9, error in=w25, Block selection=w15) -> (error out=w27, Sync found=w28, Decoded bitstream array=w29, CRC value (out) array=w30, Recieved waveform (filtered)=w31)
      Array Index(array=w29) -> (out0[_, _]=w32)
      Build Array(w20, w32) -> w33
      $Time <- w33
      To Unsigned Word Integer(number=$"Data Measurements") -> w34
      Type Cast(type=T6 "Trellis", x=w34) -> w35
      # 6.
      case (w35) {
        frame "Eye Diagram", Default {
          Property Node(instance in=w31) -> ("Y"=w37, instance out=w38)
          Array Subset(array=w37, length0=2000) -> w39
          Property Node(instance in=w38, "Y"=w39) -> (instance out=w40)
          call "MT Format Eye Diagram (complex).gvi"(waveform=w40, symbol rate=w14, eye length=2, I/Q="I", error in=w27) -> (eye diagram=w41, error out=w36)
          $"Eye Diagram" <- w41
        }
        frame "Constellation Graph" {
          call "MT Format Constellation.gvi"(waveform=w31, samples per symbol=w2) -> (constellation graph=w42, error out=w36)
          $"Constellation Graph" <- w42
        }
        frame "BER" {
          Array Size(array=w20) -> (size(s)=w43)
          $"# Sent bits" <- w43
          Not(x=w28) -> w44
          $"Sync Error" <- w44
          Array Index(array=w30) -> (out0[_, _]=w45)
          Add Array Elements(numeric array=w45) -> (sum=w46)
          Array Index(array=w29) -> (out0[_, _]=w47)
          Array Size(array=w47) -> (size(s)=w48)
          Is Equal To 0(x=w48) -> w49
          Select(s=w49, t=999, f=w46) -> w50
          $"CRC result" <- w50
          Select(s=w49, t=0, f=w48) -> w51
          $"# Recieved bits" <- w51
          call "BLER.gvi"(Number of averages=10, Input bits=w29, Reference bits=w20) -> (Averaged BLER=w52)
          $"Averaged BLER" <- w52
          call "MT Calculate BER After Trigger (User Pattern).gvi"(input bit stream=w47, reference bit pattern=w20, error in=w27) -> (BER=w53, error out=w36)
          $BER <- w53
          call "BER.gvi"(Number of averages=10, Reference bits=w20, Input bits=w29) -> (Averaged BER=w54)
          $"Averaged BER" <- w54
        }
        frame "Spectrum" {
          Property Node(instance in=w31) -> ("Y"=w55, "dt"=w56)
          Build Waveform Node(Y=w55, dt=w56) -> (output waveform=w57)
          w58 = "Averaging Parameters.gtype" {"averaging mode"="RMS averaging", "weighting mode"="Exponential", "number of averages"=10}
          call "Power Spectrum for 1 Chan (CDB).gvi"(signal=w57, averaging parameters=w58, dB on=TRUE, error in=w27) -> (power spectrum=w59, error out=w36)
          $"Power Spectrum" <- w59
        }
        frame "Trellis" {
          Property Node(instance in=w31) -> ("Y"=w60, instance out=w61)
          Array Subset(array=w60, length0=2000) -> w62
          Property Node(instance in=w61, "Y"=w62) -> (instance out=w63)
          call "MT Format Trellis Diagram.gvi"(waveform=w63, symbol rate=w14, trellis length=2, error in=w27) -> (trellis diagram=w64, error out=w36)
          $Trellis <- w64
        }
      }
      call "Filter Error Code.gvi"(code to clear=-21804, error in=w36) -> (error out=w65)
      $"Error Out" <- w65
      $"Eb/N0 [dB] (num)" <- $"Eb/N0 (SNR) [dB]"
      w66 = $stop
      Logical Or(w65, $Reinitialize, w66) -> w67
      # 5.
      call "Front Panel handler.gvi"(Enum=w15) -> (CRC LED=w68, Code LED=w69, Data LED=w70, Mod LED=w71)
      $"CRC LED" <- w68
      $"Code LED" <- w69
      $"Data LED" <- w70
      $"Mod LED" <- w71
      $"Sync LED" <- w71
      $"Channel Est LED" <- w71
      stop if w67
    }
    Logical Or(w65, w66) -> w72
    stop if w72
  }
  call "Display Error.gvi"(error in=w65)
