vi "Receiver.gvi"   [LabVIEW Communications System Design Suite 2.0.1]
panel controls:
  "IQ Sampling Rate [S/sec]": f64 = 200000
  "Carrier Frequency [Hz]": f64 = 915000000
  "Gain [dB]": f64
  "Device ID": "niUSRPClass" = "10.92.7.150"
  "Active Antenna": i32 = "RX1"(0)
  "Enabled Channel": string = "0"
  "Stop": bool
  "Tab": i32 = 4
  "Coding and CRC": "Coding and CRC.gtype" = {"Rate (k/n)"="1/2", "CRC seed"=56797}
  "Burst parameters": "Burst Parameters.gtype" = {"# Message Symbols"=256, "# Guard Symbols"=80, "Sync Bits"=64250}
  "# of samples": i64 = 40000
  "Filter": "Filter.gtype" = {"Pulse shaping filter"="Root Raised Cos", "Pulse filter parameter"=0.5, "Matched filter"="Root Raised Cos", "Matched filter parameter"=0.5}
  "MIMO Cable used": bool
panel indicators:
  "Frame Size [samples]": i64
  "Coerced IQ Sampling Rate": f64
  "Coerced Carrier Frequency": f64
  "Coerced Gain": f64
  "Constellation Graph": T1[]
  "Eye Diagram": cluster{"t0": f64, "dt": f64, "Y": f64[]}[]
  "CRC result": u16
  "# Recieved bits": i32
  "Sync found": bool
  "Power Spectrum": T2
  "Graph": cluster{"t0": f64, "dt": f64, "Y": c128[]}
  "number elements in queue": i32
  "Producer loop time": f64
  "Consumer time": f64
  "Trellis Diagram": cluster{"t0": f64, "dt": f64, "phase": f64[]}[]
types:
  T1 = cluster{"constellation": f64[], "oversampled data": f64[]}
  "Coding and CRC.gtype" = cluster{"Rate (k/n)": enum{"1/2", "2/3"}, "CRC seed": u16}
  "Burst Parameters.gtype" = cluster{"# Message Symbols": i32, "# Guard Symbols": i32, "Sync Bits": u16}
  T2 = cluster{"f0": f64, "df": f64, "magnitude": f64[]}
  T3 = enum{"none", "Raised Cosine", "Root Raised Cos", "Gaussian"}
  "Filter.gtype" = cluster{"Pulse shaping filter": T3, "Pulse filter parameter": f64, "Matched filter": T3, "Matched filter parameter": f64}
  T4 = cluster{"samples per symbol": i32, "M-PSK": i32, "differential PSK": enum{"disable", "enable"}, "PSK type": enum{"normal", "shifted", "offset"}}
  T5 = cluster{"Modulated Waveform": cluster{"t0": f64, "dt": f64, "Y": c128[]}, "Output Bit Stream": i8[]}
  T6 = enum{"Rx Constellation", "Rx Eye Diagram", "Spectrum", "Time", "Trellis", "Debug"}
  T7 = enum{"No averaging", "Vector averaging", "RMS averaging", "Peak hold"}
  "Averaging Parameters.gtype" = cluster{"averaging mode": T7, "weighting mode": enum{"Linear", "Exponential"}, "number of averages": u32}
uses:
  NI::Analysis::Measurement::Power Spectrum for 1 Chan (CDB).gvi
diagram:
  w1 = $"# of samples"
  $"Frame Size [samples]" <- w1
  w2 = $"IQ Sampling Rate [S/sec]"
  case ($"MIMO Cable used") {
    frame False, Default {
      w3 = "Internal"
    }
    frame True {
      w3 = "Mimo"
    }
  }
  w4 = cluster{"t0": f64, "dt": f64, "Y": c128[]} {all zero or empty}
  Obtain Queue(element data type=w4) -> (error out=w5, queue out=w6)
  call "niUsrp Open Rx Session.gvi"(device names=$"Device ID", reset=TRUE, error in=w5) -> (error out=w7, session handle out=w8)
  Property Node(instance in=w8, "Enabled Channels"=$"Enabled Channel", "Reference Frequency Source"=w3, "Timebase Clock Source"=w3, error in=w7) -> (error out=w9, instance out=w10)
  # 1
  Array Index(array=["RX1", "RX2"]) -> (out0[$"Active Antenna"]=w11)
  call "niUSRP Configure Signal.gvi"(session handle=w10, IQ rate=w2, carrier frequency=$"Carrier Frequency [Hz]", gain=$"Gain [dB]", error in=w9, channel list=$"Enabled Channel", active antenna=w11) -> (session handle out=w12, coerced IQ rate=w13, coerced carrier frequency=w14, coerced gain=w15, error out=w16)
  $"Coerced IQ Sampling Rate" <- w13
  $"Coerced Carrier Frequency" <- w14
  $"Coerced Gain" <- w15
  # 0
  w17 = T4 {"samples per symbol"=16, "M-PSK"=2, "differential PSK"="enable", "PSK type"="normal"}
  # 2
  # 3
  call "Modulation init.gvi"(PSK Parameters=w17, Filter=$Filter, error in=w16, Burst Parameters=$"Burst parameters", Coding and CRC=$"Coding and CRC") -> (Demodulation parameters=w18, error out=w19)
  # 4
  Property Node(instance in=w18) -> ("PSK system parameters:samples per symbol (16)"=w20)
  # 11
  # 0. Create a Queue to pass data from producer loop to the custoemr loop
  # 1. Open USRP Sesssion
  # 2. Configure HW settings (center freq, gain,ect,...)
  # 3. Initalize Modulation parameters
  # 4. Initiate (Start) USRP
  # 5. Acquire IQ waveform from USRP and passes it to a queue to pass it to the next loop under.
  # 6. Read data from quesue
  # 7. Wrapping waveform to a cluster as RxProcess Vi has cluster input.
  # 8. Get queue status
  # 9. Process modulated waveform (CRC, Modulation,etc...)
  # 10. Display measurements.
  # 11. Stops USRP acquisition
  # 12. Closes USRP session
  # 13. Releases queue reference
  # 14. Display data to user if occured.
  s1 = w19  # shift register
  while {
    # Measure time between two iterations
    Get Current Time() -> (current time=w21)
    Feedback Node(input=w21) -> w22
    Subtract(x=w21, y=w22) -> w23
    $"Consumer time" <- w23
    # 6
    Dequeue Element(error in=s1, queue=w6, timeout in ms=800000) -> (element=w24, error out=w25, queue out=w26)
    # Customer Loop
    # Check queue status
    # 8
    Get Queue Status(error in=w25, queue=w26) -> (# elements in queue=w27, error out=w28, queue out=w29)
    $"number elements in queue" <- w27
    w30 = T5 {"Modulated Waveform"={"t0"=0, "dt"=1, "Y"=[]}, "Output Bit Stream"=[]}
    # 7
    # w18: Demodulation parameters
    # w2: IQ sample rate
    Property Node(instance in=w30, "Modulated Waveform"=w24) -> (instance out=w31)
    # 9
    call "Rx data processing.gvi"(Data=w31, Demodulation paremeters=w18, error in=w28, Block selection="Raw data+CRC+Coding+Modulation") -> (error out=w32, Sync found=w33, Decoded bitstream array=w34, CRC value (out) array=w35, Recieved waveform (filtered)=w36)
    for {
      w37 = each element of w34
      w38 = each element of w35
      Array Size(array=w37) -> (size(s)=w39)
      $"# Recieved bits" <- w39
      $"Sync found" <- w33
      Add Array Elements(numeric array=w38) -> (sum=w40)
      $"CRC result" <- w40
    }
    # w20: Samples per symbol
    To Unsigned Word Integer(number=$Tab) -> w41
    Type Cast(type=T6 "Rx Constellation", x=w41) -> w42
    # -------------------------------10-----------------------------------
    # Depending on what tab is viewed on front panel only  rlevant process is calculated
    case (w42) {
      frame "Rx Constellation" {
        call "Normalize Waveform amplitude to 1.gvi"(Waveform in=w36) -> (Normalized waveform out=w44)
        # 6
        call "MT Format Constellation.gvi"(waveform=w44, samples per symbol=w20, error in=w32) -> (constellation graph=w45, error out=w43)
        $"Constellation Graph" <- w45
      }
      frame "Rx Eye Diagram" {
        Divide(x=w2, y=w20) -> w46
        Property Node(instance in=w36) -> ("Y"=w47, instance out=w48)
        Array Subset(array=w47, length0=2000) -> w49
        Property Node(instance in=w48, "Y"=w49) -> (instance out=w50)
        call "MT Format Eye Diagram (complex).gvi"(waveform=w50, symbol rate=w46, eye length=2, I/Q="Q", error in=w32) -> (eye diagram=w51, error out=w43)
        $"Eye Diagram" <- w51
      }
      frame "Debug" {
        w43 = w32
      }
      frame "Spectrum" {
        Property Node(instance in=w36) -> ("Y"=w52, "dt"=w53)
        Build Waveform Node(Y=w52, dt=w53) -> (output waveform=w54)
        w55 = "Averaging Parameters.gtype" {"averaging mode"="RMS averaging", "weighting mode"="Exponential", "number of averages"=20}
        call "Power Spectrum for 1 Chan (CDB).gvi"(signal=w54, averaging parameters=w55, dB on=TRUE, error in=w32) -> (power spectrum=w56, error out=w43)
        $"Power Spectrum" <- w56
      }
      frame "Time" {
        Property Node(instance in=w36) -> ("Y"=w57, instance out=w58)
        Property Node(instance in=w58, "Y"=w57, "t0"=0) -> (instance out=w59)
        $Graph <- w59
        w43 = w32
      }
      frame "Trellis" {
        Divide(x=w2, y=w20) -> w60
        Property Node(instance in=w36) -> ("Y"=w61, instance out=w62)
        Array Subset(array=w61, length0=2000) -> w63
        Property Node(instance in=w62, "Y"=w63) -> (instance out=w64)
        call "MT Format Trellis Diagram.gvi"(waveform=w64, symbol rate=w60, error in=w32) -> (trellis diagram=w65, error out=w43)
        $"Trellis Diagram" <- w65
      }
    }
    call "loopstopper.gvi"(Error In=w43) -> (Error Out=w66, Stop?=w67)
    next s1 = w66
    stop if w67
  }
  call "niUSRP Initiate.gvi"(session handle=w12, error in=w19) -> (session handle out=w68, error out=w69)
  s2 = w69  # shift register
  while {
    # Producer Loop
    # Measure time between two iterations
    Get Current Time() -> (current time=w70)
    Feedback Node(input=w70) -> w71
    Subtract(x=w70, y=w71) -> w72
    $"Producer loop time" <- w72
    call "niUSRP Fetch Rx Data (CDB Cluster).gvi"(session handle=w68, number of samples=w1, error in=s2) -> (session handle out=w73, data=w74, error out=w75)
    # --------------------5-------------------
    Enqueue Element(element=w74, error in=w75, queue=w6, timeout in ms=800000) -> (error out=w76)
    # This VI stops both loops if error happens or Stop button is pressed
    call "loopstopper.gvi"(Error In=w76, Stop Cond In=$Stop) -> (Error Out=w77, Stop?=w78)
    next s2 = w77
    stop if w78
  }
  call "niUSRP Abort.gvi"(session handle=w73, error in=s2) -> (session handle out=w79, error out=w80)
  call "niUSRP Close Session.gvi"(session handle=w79, error in=w80) -> (error out=w81)
  # 12
  Merge Errors(w81, s1) -> (error out=w82)
  Release Queue(error in=w82, queue=w29) -> (error out=w83)
  # 13
  # 14
  call "Simple Error Handler.gvi"(error in=w83)
