vi "Tx data processing.gvi"   [LabVIEW Communications System Design Suite 2.0.1]
inputs:
  "error in": error
  "Block selection": T1 = "Raw data"
  "Modulation parameters": "Modulation parameters.gtype"
  "symbol rate (baud)": f64 = 10000
outputs:
  "Data": T2
  "Output Bit Stream": i8[]
  "error out": error
panel controls:
  "Tab": i32 = 1
types:
  T1 = enum{"Raw data", "Raw data+CRC", "Raw data+CRC+Coding", "Raw data+CRC+Coding+Modulation"}
  T2 = cluster{"Modulated Waveform": cluster{"t0": f64, "dt": f64, "Y": c128[]}, "Output Bit Stream": i8[]}
  T3 = cluster{"samples per symbol": i32, "M-PSK": i32, "differential PSK": enum{"disable", "enable"}, "PSK type": enum{"normal", "shifted", "offset"}}
  "Burst Parameters.gtype" = cluster{"# Message Symbols": i32, "# Guard Symbols": i32, "Sync Bits": u16}
  "Coding and CRC.gtype" = cluster{"Rate (k/n)": enum{"1/2", "2/3"}, "CRC seed": u16}
  "Modulation parameters.gtype" = cluster{"PSK Parameters": T3, "pulse shaping filter coefficients": f64[], "Burst Parameters": "Burst Parameters.gtype", "Coding and CRC": "Coding and CRC.gtype"}
diagram:
  Property Node(instance in=$"Modulation parameters") -> ("Burst Parameters"=w1, "PSK Parameters"=w2, "Burst Parameters:Sync Bits"=w3, "Coding and CRC"=w4, "pulse shaping filter coefficients"=w5, "Burst Parameters:# Message Symbols"=w6, instance out=w7)
  Property Node(instance in=w4) -> ("Rate (k/n)"=w8, "CRC seed"=w9)
  Number To Boolean Array(number=w3) -> (Boolean array=w10)
  Boolean To Integer(Boolean=w10) -> (0, 1=w11)
  To Byte Integer(number=w11) -> w12
  case ($"error in") {
    frame Error {
      w13 = $"error in"
      w14 = default
      w15 = default
      w16 = default
    }
    frame No Error, Default {
      case ($"Block selection") {
        frame "Raw data" {
          Property Node(instance in=w2) -> ("M-PSK"=w17, "samples per symbol"=w18)
          Property Node(instance in=w1) -> ("# Message Symbols"=w19)
          call "Message bit generation.gvi"(# Message Symbols=w19, error in=$"error in", M-PSK=w17) -> (Output Bit Stream=w15, error out=w20)
          To Double Precision Complex(number=w15) -> w21
          call "MT Apply Pulse Shaping Filter (Generic).gvi"(symbols=w21, pulse shaping filter coefficients=w5, samples per symbol=w18, symbol rate=$"symbol rate (baud)", error in=w20) -> (output complex waveform=w14, error out=w13)
          w16 = w15
        }
        frame "Raw data+CRC" {
          Property Node(instance in=w2) -> ("M-PSK"=w22, "samples per symbol"=w23)
          Property Node(instance in=w1) -> ("# Message Symbols"=w24)
          call "Message bit generation.gvi"(# Message Symbols=w24, error in=$"error in", M-PSK=w22) -> (Output Bit Stream=w16, error out=w25)
          call "CRC.gvi"(Message In=w16, CRC seed=w9, Error In=w25, Forward?=TRUE) -> (Data out=w15, Error Out=w26)
          To Double Precision Complex(number=w15) -> w27
          call "MT Apply Pulse Shaping Filter (Generic).gvi"(symbols=w27, pulse shaping filter coefficients=w5, samples per symbol=w23, symbol rate=$"symbol rate (baud)", error in=w26) -> (output complex waveform=w14, error out=w13)
        }
        frame "Raw data+CRC+Coding" {
          Property Node(instance in=w2) -> ("M-PSK"=w28, "samples per symbol"=w29)
          Property Node(instance in=w1) -> ("# Message Symbols"=w30)
          call "Message bit generation.gvi"(# Message Symbols=w30, error in=$"error in", M-PSK=w28) -> (Output Bit Stream=w16, error out=w31)
          call "CRC.gvi"(Message In=w16, CRC seed=w9, Error In=w31, Forward?=TRUE) -> (Data out=w32, Error Out=w33)
          call "Convolutional Coder.gvi"(Input bitstream=w32, Rate (k/n)=w8, Error in=w33) -> (Coded bit stream=w15, Error out=w34)
          To Double Precision Complex(number=w15) -> w35
          call "MT Apply Pulse Shaping Filter (Generic).gvi"(symbols=w35, pulse shaping filter coefficients=w5, samples per symbol=w29, symbol rate=$"symbol rate (baud)", error in=w34) -> (output complex waveform=w14, error out=w13)
        }
        frame "Raw data+CRC+Coding+Modulation", Default {
          Property Node(instance in=w2) -> ("M-PSK"=w36)
          Property Node(instance in=w1) -> ("# Message Symbols"=w37, instance out=w38)
          # 1
          call "Message bit generation.gvi"(# Message Symbols=w37, error in=$"error in", M-PSK=w36) -> (Output Bit Stream=w16, error out=w39)
          # 2.
          call "CRC.gvi"(Message In=w16, CRC seed=w9, Error In=w39, Forward?=TRUE, # of MSG bits=w6) -> (Data out=w40, Error Out=w41)
          # 3.
          call "Convolutional Coder.gvi"(Input bitstream=w40, Rate (k/n)=w8, Error in=w41) -> (Coded bit stream=w42, Error out=w43)
          Property Node(instance in=w38) -> ("# Guard Symbols"=w44)
          # 4.
          call "Burst Building.gvi"(Sync Bits [#16]=w12, Input bit stream=w42, error in=w43, M-PSK=w36, # Guard Symbols=w44) -> (Output bit stream=w15, error out=w45)
          # 5.
          call "Modulation (PSK).gvi"(input bit stream=w15, Modulation parameters=w7, symbol rate=$"symbol rate (baud)", error in=w45) -> (error out=w13, output complex waveform=w14)
        }
      }
    }
  }
  Build Cluster(w14, w15) -> w46
  $Data <- w46
  $"error out" <- w13
  $"Output Bit Stream" <- w16
