vi "CRC prepare.gvi"   [LabVIEW Communications System Design Suite 2.0.1]
inputs:
  "Data in": u16[] = [1, 1, 1, 0, 0, 1, 0, 1, 0, 1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]
outputs:
  "Data out": u16[]
panel indicators:
  "loop iteration": i32
diagram:
  Array Size(array=$"Data in") -> (size(s)=w1)
  Subtract(x=w1, y=16) -> w2
  Delete From Array(inArray=$"Data in", length (1)=16, index0=w2) -> (outArray=w3, deleted=w4)
  # 1
  # 2
  # 1. Separate CRC value from bitstream
  # 2. Generate decimal U16 number from CRC value array
  # 3. Append CRC back to bitstream
  s1 = 0  # shift register
  s2 = 0  # shift register
  for (iteration -> i1) {
    w5 = each element of w4
    Scale By Power Of 2(n=s1, x=1) -> w6
    Multiply(w5, w6) -> w7
    Add(w7, s2) -> w8
    Increment(x=s1) -> w9
    next s1 = w9
    next s2 = w8
  }
  To Unsigned Word Integer(number=s2) -> w10
  Build Array[ConcatenateInputs=True](w3, w10) -> w11
  $"Data out" <- w11
  # 3
  $"loop iteration" <- i1
