vi "CRC test.gvi"   [LabVIEW Communications System Design Suite 2.0.1]
panel controls:
  "CRC seed": u16 = 65535
panel indicators:
  "bitstream": i8[]
  "Data out": i8[]
  "CRC value out 1": u16[]
  "CRC value out 2": u16[]
diagram:
  $bitstream <- [1, 1, 0, 0, 0, 1, 1, 0, 1, 0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]
  # 1
  # 1. Setting up a random CRC seed, and bit stream (array)
  # 2. Calcualting CRC and append it to bitsteam. Forward boolean is true, as this VI represents the mechanism of a transmitter.
  # 3. Takes bitstream and recalculate CRC. Forward boolean is false as this VI takes place in the reciever. IF CRC calue is 0, the recieved bits are the same as the sent ones.
  # 2
  call "CRC.gvi"(Message In=[1, 1, 0, 0, 0, 1, 1, 0, 1, 0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], CRC seed=$"CRC seed", Forward?=TRUE) -> (CRC value=w1)
  $"CRC value out 1" <- w1
  # This VI is testing if the CRC works fine.
  Array Size(array=[1, 1, 0, 0, 0, 1, 1, 0, 1, 0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]) -> (size(s)=w2)
  # 3
  call "CRC.gvi"(Message In=[0, 1, 1, 1, 1, 1, 1, 1, 1, 1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], CRC seed=$"CRC seed", Forward?=FALSE, # of MSG bits=w2) -> (Data out=w3, CRC value=w4)
  $"Data out" <- w3
  $"CRC value out 2" <- w4
