vi "CRC.gvi"   [LabVIEW Communications System Design Suite 2.0.1]
inputs:
  "Message In": i8[] = [1, 1, 1, 0, 0, 1, 0, 1, 0, 1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]  # Data string in (U16)
  "CRC seed": u16 = 65535  # Random number 0x[0-FFFF]
  "Error In": error = {"status"=FALSE, "code"=1, "source"="Transmitter.gvi -> MT Convolutional Encoder (Rate).gvi:430002\r\n"}
  "Forward?": bool
  "# of MSG bits": i32 = 598  # Random number 0x[0-FFFF]
outputs:
  "Data out": i8[]  # Dara array appended with CRC value
  "CRC value": u16[]
  "Error Out": error
diagram:
  # 0
  Number To Boolean Array(number=$"CRC seed") -> (Boolean array=w1)
  Boolean To Integer(Boolean=w1) -> (0, 1=w2)
  To Byte Integer(number=w2) -> w3
  case ($"Error In") {
    frame No Error, Default {
      # w3: CRC seed
      Array Size(array=w3) -> (size(s)=w7)
      # $"Forward?": Forward?
      # $"Message In": MSG
      case ($"Forward?") {
        frame False, Default {
          w8 = $"Message In"
        }
        frame True {
          Initialize Array(element=0, size=w7) -> w9
          Build Array[ConcatenateInputs=True]($"Message In", w9) -> w8
        }
      }
      # w8: Message bits
      Array Size(array=w8) -> (size(s)=w10)
      # 1
      Subtract(x=w10, y=w7) -> w11
      # Forward - Counts CRC then appends it to original data
      # Backward - Checks CRC and cuts down original CRC from message
      # 2
      # 3
      # 4
      # 5
      # 6
      # 7
      s1 = 0  # shift register
      s2 = w8  # shift register
      for (N = w10) {
        Array Subset(array=s2, index0=s1, length0=w7) -> w12
        Logical Exclusive Or(w12, w3) -> w13
        for (iteration -> i1) {
          w14 = each element of w13
          Is Not Equal To 0(x=w14) -> w15
          stop if w15
        }
        Add(i1, s1) -> w16
        Delete From Array(inArray=w13, length (1)=i1, index0=0) -> w5
        Replace Array Subset(inArray=s2, index=w16, new=w5) -> w17
        Is Equal(x=s1, y=w11) -> w18
        next s1 = w16
        next s2 = w17
        stop if w18
      }
      case ($"Forward?") {
        frame False, Default {
          Split 1D Array(array=w8, index=$"# of MSG bits") -> (first subarray=w6)
        }
        frame True {
          Replace Array Subset(inArray=w8, index=w16, new=w5) -> w6
        }
      }
      w4 = $"Error In"
    }
    frame Error {
      w4 = $"Error In"
      w5 = [1]
      w6 = $"Message In"
    }
  }
  $"Data out" <- w6
  $"CRC value" <- w5
  $"Error Out" <- w4
