vi "Bit_FIFO.gvi"   [LabVIEW Communications System Design Suite 2.0.1]
inputs:
  "Array": i8[]
  "Reset?": bool
  "Block Length (-1 output all)": i32
outputs:
  "Output Bit Stream": i8[]
  "# Bits in que": i32
diagram:
  Is First Call() -> w1
  Logical Or($"Reset?", w1) -> w2
  s1 = uninitialised  # shift register
  while {
    Build Array[ConcatenateInputs=True](s1, $Array) -> w3
    Select(s=w2, t=$Array, f=w3) -> w4
    Array Size(array=w4) -> (size(s)=w5)
    Is Less Or Equal(x=w5, y=$"Block Length (-1 output all)") -> w6
    Is Less Than 0(x=$"Block Length (-1 output all)") -> w7
    Logical Or(w6, w7) -> w8
    case (w8) {
      frame True {
        w9 = i8[] []
        w10 = w4
      }
      frame False {
        Split 1D Array(array=w4, index=$"Block Length (-1 output all)") -> (first subarray=w10, second subarray=w9)
      }
    }
    next s1 = w9
    continue if FALSE
  }
  $"Output Bit Stream" <- w10
  Array Size(array=s1) -> (size(s)=w11)
  $"# Bits in que" <- w11
