vi "Burst Building.gvi"   [LabVIEW Communications System Design Suite 2.0.1]
inputs:
  "Sync Bits [#16]": i8[]
  "Input bit stream": i8[]
  "error in": error
  "M-PSK": i32
  "# Guard Symbols": i32 = 128
outputs:
  "Output bit stream": i8[]
  "error out": error
diagram:
  # 1
  # 2
  # 3
  # 4
  # 1.Generated BITS are calculated by the log2(M-PSK)*MSG Symbols. e.g.: M-PSK=4; Msg symbols==10 generated bits=20
  # 2. Guard bits are all ones. (111..1).
  # 3. Sync bits are generated by the 32 long 'Sync Bits [#32] array.
  # 4. After everything is generated, guard and sync bits are added to the msg. (Guard+Sync+MSG bits, respectively)
  # init array
  case ($"error in") {
    frame Error {
      w1 = $"Input bit stream"
      w2 = $"error in"
    }
    frame No Error {
      To Double Precision Float(number=$"M-PSK") -> w3
      Logarithm Base 2(x=w3) -> w4
      To Long Integer(number=w4) -> w5
      Multiply(w5, $"# Guard Symbols") -> w6
      # Generate Guard
      call "MT Generate Bits (User Defined).gvi"(total bits=w6, error in=$"error in", user base bit pattern=[1]) -> (output bit stream=w7, error out=w8)
      # Guard bits are prepended
      # to Sync and message bits.
      call "MT Generate Bits (User Defined).gvi"(total bits=16, error in=w8, user base bit pattern=$"Sync Bits [#16]") -> (output bit stream=w9, error out=w2)
      Array Size(array=w7) -> (size(s)=w10)
      Divide(x=w10, y=2) -> w11
      Split 1D Array(array=w7, index=w11) -> (first subarray=w12, second subarray=w13)
      Build Array[ConcatenateInputs=True](w12, w9, $"Input bit stream", w13) -> w1
    }
  }
  $"Output bit stream" <- w1
  $"error out" <- w2
