vi "Coder test.gvi"   [LabVIEW Communications System Design Software 2.0.1]
panel controls:
  "# of sent bits without CRC": i32 = 128
  "With CRC": bool
  "Rate (k/n)": enum{"1/2", "2/3"} = "1/2"
panel indicators:
  "Own decoded bits": i8[]
  "# of Own decoded bits": i32
  "Original": i8[]
  "CRC value out": u16[]
diagram:
  call "MT Generate Bits (Galois, PN Order).gvi"(total bits=$"# of sent bits without CRC") -> (output bit stream=w1, error out=w2)
  $Original <- w1
  # 1
  # 2
  # 3
  # 4
  # 5
  # 1. Generating random bits.
  # 2. Calculate CRC value.
  # 3. Coding the stream using the custom codder and the one from MT (Modulation Toolkit).
  # 4. Decoding the stream, corresponding to the used (coding) rate.
  # Recalculating CRC and see if there was a mistake.
  case ($"With CRC") {
    frame True {
      Array Size(array=w1) -> (size(s)=w6)
      To Unsigned Word Integer(number=w1) -> w7
      call "CRC.gvi"(Message In=w7, Error In=w2, Forward?=TRUE) -> (Data out=w8, Error Out=w9)
      To Byte Integer(number=w8) -> w10
      call "Convolutional Coder.gvi"(Input bitstream=w10, Rate (k/n)=$"Rate (k/n)", Error in=w9) -> (Coded bit stream=w11, Error out=w12)
      call "Convolutional Decoder.gvi"(Coding rate=$"Rate (k/n)", Coded bit stream=w11, Error in=w12) -> (Decoded bits=w13, Error Out=w14)
      To Unsigned Word Integer(number=w13) -> w15
      call "CRC.gvi"(Message In=w15, Error In=w14, Forward?=FALSE, # of MSG bits=w6) -> (Data out=w16, CRC value=w5, Error Out=w4)
      To Byte Integer(number=w16) -> w3
    }
    frame False {
      call "Convolutional Coder.gvi"(Input bitstream=w1, Rate (k/n)=$"Rate (k/n)", Error in=w2) -> (Coded bit stream=w17, Error out=w18)
      call "Convolutional Decoder.gvi"(Coding rate=$"Rate (k/n)", Coded bit stream=w17, Error in=w18) -> (Decoded bits=w3, Error Out=w4)
      w5 = [999]
    }
  }
  $"Own decoded bits" <- w3
  Array Size(array=w3) -> (size(s)=w19)
  $"# of Own decoded bits" <- w19
  $"CRC value out" <- w5
  call "Display Error.gvi"(error in=w4)
