vi "Convolutional Coder.gvi"   [LabVIEW Communications System Design Suite 2.0.1]
inputs:
  "Input bitstream": i8[]
  "Rate (k/n)": enum{"1/2", "2/3"} = "1/2"
  "Error in": error
outputs:
  "Coded bit stream": i8[]
  "Error out": error
diagram:
  # 1
  # 2
  # 3
  # 1. Selecting the proper coder, based on the status of the enum "Rate (k/n)".
  # 2. Adding as many 0 bits to the end of the stream as the constraint length is of the specific coder. It is needed to prevent loosing data on the decoder side.
  # 3. Generating the coded bitstream.
  # todo tuncrate + viterbinél is
  # build burst
  case ($"Error in") {
    frame Error {
      w1 = $"Error in"
      w2 = $"Input bitstream"
    }
    frame No Error {
      case ($"Rate (k/n)") {
        frame "1/2", Default {
          Array Size(array=$"Input bitstream") -> (size(s)=w3)
          Initialize Array(element=0, size=7) -> w4
          Insert Into Array(inArray=$"Input bitstream", index0=w3, new=w4) -> w5
          for {
            w6 = each element of w5
            Feedback Node(initial value=0, input=w7) -> w8
            Feedback Node(initial value=0, input=w6) -> w9
            Feedback Node(initial value=0, input=w9) -> w10
            Feedback Node(initial value=0, input=w10) -> w7
            Feedback Node(initial value=0, input=w11) -> w12
            Logical Exclusive Or(w12, w7, w10, w9, w6) -> w13
            To Byte Integer(number=w13) -> w14
            Feedback Node(initial value=0, input=w8) -> w11
            Logical Exclusive Or(w12, w11, w7, w10, w6) -> w15
            To Byte Integer(number=w15) -> w16
            Build Array(w16, w14) -> w17
            concatenate w17 onto w2
          }
          w1 = $"Error in"
        }
        frame "2/3" {
          Array Size(array=$"Input bitstream") -> (size(s)=w18)
          Initialize Array(element=0, size=4) -> w19
          Insert Into Array(inArray=$"Input bitstream", index0=w18, new=w19) -> w20
          Decimate Array(array=w20) -> (out0=w21, out1=w22)
          for {
            w23 = each element of w21
            w24 = each element of w22
            Feedback Node(initial value=0, input=w24) -> w25
            Feedback Node(initial value=0, input=w25) -> w26
            Feedback Node(initial value=0, input=w27) -> w28
            Logical Exclusive Or(w28, w23, w25, w26) -> w29
            Feedback Node(initial value=0, input=w23) -> w30
            Feedback Node(initial value=0, input=w30) -> w27
            Logical Exclusive Or(w28, w27, w30, w24, w26) -> w31
            Logical Exclusive Or(w30, w23, w25) -> w32
            Build Array(w29, w31, w32) -> w33
            concatenate w33 onto w2
          }
          w1 = $"Error in"
        }
      }
    }
  }
  $"Coded bit stream" <- w2
  $"Error out" <- w1
