vi "Convolutional Decoder.gvi"   [LabVIEW Communications System Design Software 2.0.1]
inputs:
  "Coding rate": enum{"1/2", "2/3"} = "1/2"
  "Coded bit stream": i8[]
  "Error in": error
outputs:
  "Decoded bits": i8[]
  "Error Out": error
diagram:
  case ($"Error in") {
    frame Error {
      w1 = $"Error in"
      w2 = i8[] []
    }
    frame No Error {
      case ($"Coding rate") {
        frame "1/2", Default {
          call "MT Convolutional Decoder (Viterbi Hard Decision, Rate).gvi"(input bit stream=$"Coded bit stream", rate="1/2", constraint length=7, error in=$"Error in", traceback depth=7) -> (output bit stream=w2, error out=w1)
        }
        frame "2/3" {
          call "MT Convolutional Decoder (Viterbi Hard Decision, Generator Matrix).gvi"(input bit stream=$"Coded bit stream", generator matrix=[[36, 24], [28, 40], [48, 16]], constraint length=4, error in=$"Error in", traceback depth=4) -> (output bit stream=w2, error out=w1)
        }
      }
    }
  }
  $"Decoded bits" <- w2
  $"Error Out" <- w1
