vi "LFSR Generation.gvi"   [LabVIEW Communications System Design Suite 2.0.1]
inputs:
  "# of bits to genreate": i32 = 140
  "PN sequence orger": enum{"galois-6", "galois-8", "galois-10"} = "galois-6"
  "Error In": error
outputs:
  "bits out": i8[]
  "spectrum of bits out": T1
  "Error Out": error
types:
  T1 = cluster{"f0": f64, "df": f64, "magnitude": f64[]}
  T2 = enum{"No averaging", "Vector averaging", "RMS averaging", "Peak hold"}
  "Averaging Parameters.gtype" = cluster{"averaging mode": T2, "weighting mode": enum{"Linear", "Exponential"}, "number of averages": u32}
uses:
  NI::Analysis::Measurement::Power Spectrum for 1 Chan (CDB).gvi
diagram:
  case ($"Error In") {
    frame Error {
      w1 = default
      w2 = default
      w3 = $"Error In"
    }
    frame No Error {
      s1 = i8[] []  # shift register
      for (N = $"# of bits to genreate") {
        case ($"PN sequence orger") {
          frame "galois-6", Default {
            Is First Call() -> w5
            Feedback Node(input=w6) -> w7
            Feedback Node(input=w7) -> w8
            Feedback Node(input=w9) -> w10
            Feedback Node(input=w10) -> w11
            Logical Exclusive Or(w11, w10, w8, w7) -> w12
            Select(s=w5, t=TRUE, f=w12) -> w13
            Feedback Node(input=w13) -> w6
            # 02356
            Feedback Node(input=w8) -> w9
            Build Array(w13, w6, w7, w8, w9, w10, w11) -> w4
          }
          frame "galois-8" {
            Feedback Node(input=w14) -> w15
            Feedback Node(input=w15) -> w16
            Feedback Node(input=w16) -> w17
            Feedback Node(input=w17) -> w18
            # 04568
            Feedback Node(input=w18) -> w19
            Feedback Node(input=w19) -> w20
            Feedback Node(input=w20) -> w21
            Feedback Node(input=w21) -> w22
            Build Array(w15, w16, w17, w18, w19, w20, w21, w22) -> w4
            Is First Call() -> w23
            Logical Exclusive Or(w22, w20, w19, w18) -> w24
            Select(s=w23, t=TRUE, f=w24) -> w14
          }
          frame "galois-10" {
            Feedback Node(input=w25) -> w26
            Feedback Node(input=w26) -> w27
            Feedback Node(input=w27) -> w28
            Feedback Node(input=w28) -> w29
            # 0 7 10
            Feedback Node(input=w29) -> w30
            Feedback Node(input=w30) -> w31
            Feedback Node(input=w31) -> w32
            Feedback Node(input=w32) -> w33
            Feedback Node(input=w33) -> w34
            Feedback Node(input=w34) -> w35
            Build Array(w26, w27, w28, w29, w30, w31, w32, w33, w34, w35) -> w4
            Is First Call() -> w36
            Logical Exclusive Or(w35, w32) -> w37
            Select(s=w36, t=TRUE, f=w37) -> w25
          }
        }
        for {
          w38 = each element of w4
          Select(s=w38, t=1, f=0) -> w39
        }
        Array Index(array=w4) -> (out0[_]=w40)
        Select(s=w40, t=1, f=0) -> w41
        Build Array[ConcatenateInputs=True](w41, s1) -> w42
        Array Subset(array=w42, index0=0, length0=$"# of bits to genreate") -> w2
        Array Size(array=w42) -> (size(s)=w43)
        Is Greater Or Equal(x=w43, y=$"# of bits to genreate") -> w44
        next s1 = w42
        stop if w44
      }
      w45 = "Averaging Parameters.gtype" {"averaging mode"="RMS averaging", "weighting mode"="Exponential", "number of averages"=10}
      call "Power Spectrum for 1 Chan (CDB).gvi"(signal=w2, averaging parameters=w45, dB on=TRUE, error in=$"Error In") -> (power spectrum=w1, error out=w3)
    }
  }
  $"bits out" <- w2
  $"spectrum of bits out" <- w1
  $"Error Out" <- w3
