vi "Message bit generation.gvi"   [LabVIEW Communications System Design Suite 2.0.1]
inputs:
  "# Message Symbols": i32 = 128
  "error in": error
  "M-PSK": i32
outputs:
  "Output Bit Stream": i8[]
  "error out": error
diagram:
  # 1
  # 2
  # 1. Generated BITS are calculated by the log2(M-PSK)*MSG Symbols. e.g.: M-PSK=4; Msg symbols==10 generated bits=20
  # 2. Generate N bits using PN=9 sequence for proper correlation.
  case ($"error in") {
    frame No Error, Default {
      To Double Precision Float(number=$"M-PSK") -> w3
      Logarithm Base 2(x=w3) -> w4
      To Long Integer(number=w4) -> w5
      # Output a bit stream with max
      # Block Length # of bits
      Multiply(w5, $"# Message Symbols") -> w6
      Is First Call() -> w7
      call "MT Generate Bits (Galois, PN Order).gvi"(total bits=w6, PN sequence order=9, error in=$"error in", reset?=w7) -> (output bit stream=w1, error out=w2)
    }
    frame Error {
      w1 = default
      w2 = $"error in"
    }
  }
  $"Output Bit Stream" <- w1
  $"error out" <- w2
