vi "AWGN generation.gvi"   [LabVIEW Communications System Design Suite 2.0.1]
inputs:
  "Waveform in": cluster{"t0": f64, "dt": f64, "Y": c128[]} = {"t0"=0, "dt"=1, "Y"=[]}
  "symbol rate": f64 = 10000
  "eb/n0 [dB of complex]": f64 = 10
  "Error In": error
outputs:
  "Error Out": error
  "Waveform out": cluster{"t0": f64, "dt": f64, "Y": c128[]}
uses:
  NI::Analysis::Generation::Gaussian White Noise.gvi
diagram:
  case ($"Error In") {
    frame Error {
      w1 = $"Waveform in"
      w2 = $"Error In"
    }
    frame No Error {
      Property Node(instance in=$"Waveform in") -> ("Y"=w3, "dt"=w4)
      Array Size(array=w3) -> (size(s)=w5)
      # dB to lin
      Divide(x=$"eb/n0 [dB of complex]", y=10) -> w6
      Power Of 10(x=w6) -> w7
      w8 = 2  # M(PSK)
      Logarithm Base 2(x=w8) -> w9
      # bitrate
      Multiply(w7, w9) -> w10
      # Es/N0 = Eb/Na*log_{2}M
      # Es/N0 = (C/N)*(B/fs)
      #
      # Es/N0 = energy per symbol
      # C/N = Carrier of Signal to noise ratio
      # B = Channel BW
      # Fs = Symbol per second
      Reciprocal(x=w4) -> w11
      Divide(x=w10, y=w11) -> w12
      Multiply($"symbol rate", w12) -> w13
      Multiply(w13, 2) -> w14
      for {
        w15 = each element of w3
        Absolute Value(x=w15) -> w17
        Square(x=w17) -> w18
        append w18 to w16
      }
      Add Array Elements(numeric array=w16) -> (sum=w19)
      # E = power of signal
      # w20: E
      Divide(x=w19, y=w5) -> w20
      Divide(x=w20, y=w14) -> w21
      # w22: Noise  dev
      Square Root(x=w21) -> w22
      call "Gaussian White Noise.gvi"(samples=w5, standard deviation=w22, seed=-1) -> (Gaussian white noise=w23)
      call "Gaussian White Noise.gvi"(samples=w5, standard deviation=w22) -> (Gaussian white noise=w24)
      # Add noise to signal
      Real And Imaginary To Complex(x=w24, y=w23) -> w25
      Add(w3, w25) -> w26
      Property Node(instance in=$"Waveform in", "Y"=w26) -> (instance out=w1)
      # Generate random numbers between -1 and 1
      for (N = w5) {
        Random Number() -> (number (0 to 1)=w28)
        append w28 to w27
      }
      Multiply(w27, 2) -> w29
      Subtract(x=w29, y=1) -> w30
      # Multiply random numbers with Noise
      Multiply(w30, 1) -> w31
      Multiply(w22, w31)
      for (N = w5) {
        Random Number() -> (number (0 to 1)=w33)
        append w33 to w32
      }
      Multiply(2, w32) -> w34
      Subtract(x=w34, y=1) -> w35
      Multiply(w35, 1) -> w36
      Multiply(w22, w36)
      # multiply by to as WFM is complex
      call "LFSR Generation.gvi"()
      call "LFSR Generation.gvi"()
      w2 = $"Error In"
    }
  }
  $"Waveform out" <- w1
  $"Error Out" <- w2
