vi "BLER.gvi"   [LabVIEW Communications System Design Software 2.0.1]
inputs:
  "Number of averages": i32 = 1
  "Input bits": i8[][]
  "Reference bits": i8[]
  "error in": error
outputs:
  "Averaged BLER": f64
  "error out": error
diagram:
  # 1. Not equal to one function checks if current message was recieved correctly.
  # 2. Generates a windowed average of the last "N" BLER calculations.
  # 3. If there's no data, error is countered.
  case ($"error in") {
    frame No Error, Default {
      s1 = uninitialised  # shift register
      for {
        w3 = each element of $"Input bits"
        Is Not Equal(x=w3, y=$"Reference bits") -> w4
        Boolean To Integer(Boolean=w4) -> (0, 1=w5)
        To Unsigned Long Integer(number=w5) -> w6
        Add Array Elements(numeric array=w6) -> (sum=w7)
        Is Greater(x=w7, y=0) -> w8
        # ----------------1---------------
        Select(s=w8, t=1, f=0) -> w9
        Build Array[ConcatenateInputs=True](w9, s1) -> w10
        # ----------------2---------------
        Delete From Array(inArray=w10, length (1)=$"Number of averages", index0=0) -> (deleted=w11)
        Add Array Elements(numeric array=w11) -> (sum=w12)
        Divide(x=w12, y=$"Number of averages") -> w13
        next s1 = w11
        stop if TRUE
      }
      Array Index(array=$"Input bits") -> (out0[_, _]=w14)
      Array Size(array=w14) -> (size(s)=w15)
      Is Not Equal To 0(x=w15) -> w16
      # --------3--------
      Select(s=w16, t=w13, f=1) -> w2
      w1 = $"error in"
    }
    frame Error {
      w1 = $"error in"
      w2 = NaN
    }
  }
  $"Averaged BLER" <- w2
  $"error out" <- w1
