vi "Normalize Waveform amplitude to 1.gvi"   [LabVIEW Communications System Design Suite 2.0.1]
inputs:
  "Waveform in": cluster{"t0": f64, "dt": f64, "Y": c128[]} = {"t0"=0, "dt"=6.25e-06, "Y"=[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]}
outputs:
  "Normalized waveform out": cluster{"t0": f64, "dt": f64, "Y": c128[]}
uses:
  NI::Analysis::Statistics::Measures of Mean.gvi
diagram:
  Property Node(instance in=$"Waveform in") -> ("Y"=w1, instance out=w2)
  Complex To Polar(r * e^(i*theta)=w1) -> (r=w3)
  Power Of 2(x=w3) -> w4
  call "Measures of Mean.gvi"(x=w4) -> (mean value=w5)
  Divide(x=w5, y=0.01) -> w6
  Logarithm Base 2(x=w6) -> w7
  Divide(x=w1, y=w7) -> w8
  Property Node(instance in=w2, "Y"=w8) -> (instance out=w9)
  $"Normalized waveform out" <- w9
