vi "loopstopper.gvi"   [LabVIEW Communications System Design Suite 2.0.1]
# This VI functions as an FGV (Functional Global Variable)
# If gets any error or stop boolean is true it passes it to an OR gate. The third input is aloopback of the OR gate's output through a shift register, so it will keep its state after a true value recieved.
inputs:
  "Error In": error
  "Stop Cond In": bool
outputs:
  "Error Out": error
  "Stop?": bool
diagram:
  $"Error Out" <- $"Error In"
  # This VI functions as an FGV (Functional Global Variable)
  # If gets any error or stop boolean is true it passes it to an OR gate. The third input is aloopback of the OR gate's output through a shift register, so it will keep its state after a true value recieved.
  Feedback Node(initial value=FALSE, input=w1) -> w2
  Logical Or($"Error In", $"Stop Cond In", w2) -> w1
  $"Stop?" <- w1
