vi "Demodulation (PSK).gvi"   [LabVIEW Communications System Design Software 2.0.1]
inputs:
  "Waveform in": cluster{"t0": f64, "dt": f64, "Y": c128[]} = {"t0"=0, "dt"=1, "Y"=[]}
  "error in": error
  "Demodulation parameters": "Demodulation parameters.gtype"
outputs:
  "Messages out": i8[][]
  "error out": error
  "Sync found": bool
  "output complex waveform": cluster{"t0": f64, "dt": f64, "Y": c128[]}
panel indicators:
  "Graph": f64[][]
types:
  T1 = cluster{"samples per symbol (16)": i32, "symbol map": c128[], "differential PSK": enum{"disable", "enable"}, "PSK type": enum{"normal", "shifted", "offset"}}
  "Burst Parameters.gtype" = cluster{"# Message Symbols": i32, "# Guard Symbols": i32, "Sync Bits": u16}
  "Coding and CRC.gtype" = cluster{"Rate (k/n)": enum{"1/2", "none"}, "CRC seed": u16}
  "Demodulation parameters.gtype" = cluster{"PSK system parameters": T1, "pulse shaping filter coefficients": f64[], "matched filter coefficients": f64[], "Burst Parameters": "Burst Parameters.gtype", "Coding and CRC": "Coding and CRC.gtype"}
diagram:
  # 1. Matched Filtering
  # 2. Finding the middle of a symbol  (as it was oversampled) using gardner algorithm.
  # 3. Decimate oversampled data using error array of gardner.
  # 4. turn BPSK symbols to 0 and 1. (decision making)
  # 5. Find sync sequence. If found cut down the message bits from burst (guard and sinc bits)
  # 6. Calculating the lenght of the message symbols. (add CRC; + additional bits from coding; multibly because of the code rate.)
  case ($"error in") {
    frame Error {
      w1 = $"error in"
      w2 = default
      w3 = $"Waveform in"
      w4 = default
    }
    frame No Error {
      # 1
      call "Matched Filtering.gvi"(Modulated waveform in=$"Waveform in", Error in=$"error in", Demodulation parameters=$"Demodulation parameters") -> (Filtered waveform out=w3, Filtered bits out=w5, Error out=w6)
      Initialize Array(element=0+0i, size=0) -> w7
      Build Array[ConcatenateInputs=True](w7, w5) -> w8
      # 2
      call "Timing Recovery.gvi"(Bits in=w8, Demodulation parameters=$"Demodulation parameters", Error In=w6) -> (Error Out=w9, Bits out=w10, Timing shift=w11)
      Complex To Real Imaginary(x + iy=w10) -> (x=w12)
      # 3
      call "Decimating.gvi"(Timing shift=w11, Bits in=w10, Demodulation parameters=$"Demodulation parameters", Error In=w9) -> (Decimated bits out=w13, Error Out=w14, Array=w15)
      Boolean To Integer(Boolean=w15) -> (0, 1=w16)
      Multiply(w16, 3) -> w17
      Build Array(w12, w17) -> w18
      $Graph <- w18
      Property Node(instance in=$"Demodulation parameters") -> ("Burst Parameters:Sync Bits"=w19, "Burst Parameters:# Message Symbols"=w20, "Coding and CRC:Rate (k/n)"=w21)
      # 4
      call "Decision.gvi"(Bits in=w13, Error In=w14) -> (Demodulated bits=w22, Error Out=w23)
      # w21: Coding Rate
      # 6
      case (w21) {
        frame "1/2", Default {
          w24 = 2
          w25 = 7
        }
        frame "none" {
          Divide(x=3, y=2) -> w24
          w25 = 4
        }
      }
      # w20: #Message symbols
      Add(w20, 16) -> w26
      # w19: Sync bits
      Add(w26, w25) -> w27
      To Double Precision Float(number=w27) -> w28
      Multiply(w28, w24) -> w29
      To Long Integer(number=w29) -> w30
      # 5
      call "Sync search.gvi"(Bits in=w22, Sync bits=w19, Burst Parameters:# Message Symbols=w30, Error In=w23) -> (Sync found=w2, Messages out=w4, Error Out=w1)
    }
  }
  $"output complex waveform" <- w3
  $"Messages out" <- w4
  $"Sync found" <- w2
  $"error out" <- w1
