vi "Dacimating.gvi"   [LabVIEW Communications System Design Software 2.0.1]
inputs:
  "Error arary in": f64[]
  "Bits in": c128[]
  "Demodulation parameters": "Demodulation parameters.gtype"
  "Error In": error
outputs:
  "Decimated bits out": c128[]
  "Error Out": error
  "Array": bool[]
types:
  T1 = cluster{"samples per symbol (16)": i32, "symbol map": c128[], "differential PSK": enum{"disable", "enable"}, "PSK type": enum{"normal", "shifted", "offset"}}
  "Burst Parameters.gtype" = cluster{"# Message Symbols": i32, "# Guard Symbols": i32, "Sync Bits": u16}
  "Coding and CRC.gtype" = cluster{"Rate (k/n)": enum{"1/2", "2/3"}, "CRC seed": u16}
  "Demodulation parameters.gtype" = cluster{"PSK system parameters": T1, "pulse shaping filter coefficients": f64[], "matched filter coefficients": f64[], "Burst Parameters": "Burst Parameters.gtype", "Coding and CRC": "Coding and CRC.gtype"}
diagram:
  # 0
  # 1
  # 2
  # Decimating the input array. Evry 16th bit is taken (or as many as the "samples per symbol"). The reference is the minimum point of the "error array".
  case ($"Error In") {
    frame Error {
      w1 = $"Bits in"
      w2 = $"Error In"
      w3 = default
    }
    frame No Error {
      Property Node(instance in=$"Demodulation parameters") -> ("PSK system parameters:samples per symbol (16)"=w4)
      # w4: Samples per symbol
      Multiply(100, w4) -> w5
      Array Subset(array=$"Error arary in", length0=w5) -> w6
      Absolute Value(x=w6) -> w7
      Array Max And Min(array=w7) -> (min index(es)=w8)
      Quotient And Remainder(x=w8, y=w4) -> (x-y*floor(x/y)=w9)
      # Decimating
      # F(bit)
      for (iteration -> i1) {
        w10 = each element of $"Bits in"
        Quotient And Remainder(x=i1, y=w4) -> (x-y*floor(x/y)=w11)
        Is Equal(x=w9, y=w11) -> w12
        append w10 to w1 if w12
        append w12 to w3
      }
      w2 = $"Error In"
    }
  }
  $"Decimated bits out" <- w1
  $Array <- w3
  $"Error Out" <- w2
