vi "Decimating.gvi"   [LabVIEW Communications System Design Software 2.0.1]
inputs:
  "Timing shift": i16
  "Bits in": c128[]
  "Demodulation parameters": "Demodulation parameters.gtype"
  "Error In": error
outputs:
  "Decimated bits out": c128[]
  "Error Out": error
  "Array": bool[]
types:
  T1 = cluster{"samples per symbol (16)": i32, "symbol map": c128[], "differential PSK": enum{"disable", "enable"}, "PSK type": enum{"normal", "shifted", "offset"}}
  "Burst Parameters.gtype" = cluster{"# Message Symbols": i32, "# Guard Symbols": i32, "Sync Bits": u16}
  "Coding and CRC.gtype" = cluster{"Rate (k/n)": enum{"1/2", "none"}, "CRC seed": u16}
  "Demodulation parameters.gtype" = cluster{"PSK system parameters": T1, "pulse shaping filter coefficients": f64[], "matched filter coefficients": f64[], "Burst Parameters": "Burst Parameters.gtype", "Coding and CRC": "Coding and CRC.gtype"}
diagram:
  # 0
  # 1
  # 2
  # Decimating the input array. Evry 16th bit is taken (or as many as the "samples per symbol"). The reference is the minimum point of the "error array".
  case ($"Error In") {
    frame Error {
      w1 = $"Bits in"
      w2 = $"Error In"
      w3 = default
    }
    frame No Error {
      # w4: Samples per symbol
      Property Node(instance in=$"Demodulation parameters") -> ("PSK system parameters:samples per symbol (16)"=w4)
      # Decimating
      # F(bit)
      for (iteration -> i1) {
        w5 = each element of $"Bits in"
        Add(0, i1) -> w6
        Quotient And Remainder(x=w6, y=w4) -> (x-y*floor(x/y)=w7)
        Is Equal(x=$"Timing shift", y=w7) -> w8
        append w5 to w1 if w8
        append w8 to w3
      }
      w2 = $"Error In"
    }
  }
  $"Decimated bits out" <- w1
  $Array <- w3
  $"Error Out" <- w2
