vi "Decision.gvi"   [LabVIEW Communications System Design Software 2.0.1]
inputs:
  "Bits in": c128[]
  "Error In": error
outputs:
  "Demodulated bits": i8[]
  "Error Out": error
diagram:
  # 1
  # 2
  # multiply by Z^(-1)
  # Decision
  # Multiply by a delayed bit and negate it. After this calculation it the bit is greather than 0 it means this is a 1 bit it it is less than 0 it is 0 bit.
  case ($"Error In") {
    frame Error {
      w1 = default
      w2 = $"Error In"
    }
    frame No Error {
      for {
        w3 = each element of $"Bits in"
        Feedback Node(input=w3) -> w4
        Complex Conjugate(x + iy=w4) -> w5
        Multiply(w3, w5) -> w6
        Complex To Polar(r * e^(i*theta)=w6) -> (theta=w7)
        Absolute Value(x=w7) -> w8
        Is Greater(x=w8, y=1) -> w9
        Select(s=w9, t=1, f=0) -> w10
        append w10 to w1
      }
      w2 = $"Error In"
    }
  }
  $"Demodulated bits" <- w1
  $"Error Out" <- w2
