vi "Matched Filtering.gvi"   [LabVIEW Communications System Design Software 2.0.1]
inputs:
  "Modulated waveform in": cluster{"t0": f64, "dt": f64, "Y": c128[]}
  "Error in": error
  "Demodulation parameters": "Demodulation parameters.gtype"
outputs:
  "Filtered waveform out": cluster{"t0": f64, "dt": f64, "Y": c128[]}
  "Filtered bits out": c128[]
  "Error out": error
types:
  T1 = cluster{"samples per symbol (16)": i32, "symbol map": c128[], "differential PSK": enum{"disable", "enable"}, "PSK type": enum{"normal", "shifted", "offset"}}
  "Burst Parameters.gtype" = cluster{"# Message Symbols": i32, "# Guard Symbols": i32, "Sync Bits": u16}
  "Coding and CRC.gtype" = cluster{"Rate (k/n)": enum{"1/2", "none"}, "CRC seed": u16}
  "Demodulation parameters.gtype" = cluster{"PSK system parameters": T1, "pulse shaping filter coefficients": f64[], "matched filter coefficients": f64[], "Burst Parameters": "Burst Parameters.gtype", "Coding and CRC": "Coding and CRC.gtype"}
  "filter structure.gtype" = u32
  "filter.gtype" = cluster{"filter structure": "filter structure.gtype", "forward coefficients": f64[], "reverse coefficients": f64[], "sampling frequency": f64}
uses:
  NI::Analysis::Filtering::Filtering (CDB).gvi
diagram:
  # ---------------------------------1----------------------------------
  # 2
  # 3
  # 1. If no filter used, the array doesn't contain evrything. In this case we assuem that 1 bit is the length of the array
  # 2. Adding elements to the end of the array that will be cut down by the filter. I have added more, because the rest will be cut down after sync found
  # 		# of 0+j bits = 2*samples per symbol*(filter length+1)
  # 3. Matched filtering.
  case ($"Error in") {
    frame Error {
      w1 = $"Error in"
      w2 = $"Modulated waveform in"
      w3 = c128[] []
    }
    frame No Error {
      Property Node(instance in=$"Modulated waveform in") -> ("Y"=w4, instance out=w5)
      Property Node(instance in=$"Demodulation parameters") -> ("matched filter coefficients"=w6, "PSK system parameters:samples per symbol (16)"=w7)
      # w6: Matched Filter Coefficients
      Array Size(array=w6) -> (size(s)=w8)
      Array Subset(array=w4, index0=0, length0=w8) -> w9
      Build Array[ConcatenateInputs=True](w9, w4) -> w10
      Property Node(instance in=w5, "Y"=w10) -> (instance out=w11)
      w12 = "filter.gtype" {"filter structure"=3, "forward coefficients"=[], "reverse coefficients"=[], "sampling frequency"=0}
      Property Node(instance in=w12, "forward coefficients"=w6) -> (instance out=w13)
      call "Filtering (CDB).gvi"(signal=w10, filter=w13) -> (filtered signal=w14)
      Delete From Array(inArray=w14, length (1)=w8, index0=0) -> w3
      Property Node(instance in=w11, "Y"=w3) -> (instance out=w2)
      # Matched filtering
      call "MT Apply Matched Filter (Generic).gvi"(input complex waveform=w11, matched filter coefficients=w6, samples per symbol=w7, error in=$"Error in") -> (output complex waveform=w15, error out=w1)
      Property Node(instance in=w15)
      Array Size(array=w4)
      Initialize Array(element=0.075+0i, size=w8)
      # w7: Samples ber symbol
      Decrement(x=w8) -> w16
      Is Less Or Equal To 0(x=w16) -> w17
      Select(s=w17, t=1, f=w16) -> w18
      Multiply(2, w18) -> w19
      Multiply(w19, w7)
    }
  }
  $"Filtered waveform out" <- w2
  $"Filtered bits out" <- w3
  $"Error out" <- w1
