vi "Timing Recovery.gvi"   [LabVIEW Communications System Design Software 2.0.1]
inputs:
  "Bits in": c128[]
  "Demodulation parameters": "Demodulation parameters.gtype"
  "Error In": error
outputs:
  "Error Out": error
  "Bits out": c128[]
  "Timing shift": i16
panel indicators:
  "Graph": f64[][]
types:
  T1 = cluster{"samples per symbol (16)": i32, "symbol map": c128[], "differential PSK": enum{"disable", "enable"}, "PSK type": enum{"normal", "shifted", "offset"}}
  "Burst Parameters.gtype" = cluster{"# Message Symbols": i32, "# Guard Symbols": i32, "Sync Bits": u16}
  "Coding and CRC.gtype" = cluster{"Rate (k/n)": enum{"1/2", "none"}, "CRC seed": u16}
  "Demodulation parameters.gtype" = cluster{"PSK system parameters": T1, "pulse shaping filter coefficients": f64[], "matched filter coefficients": f64[], "Burst Parameters": "Burst Parameters.gtype", "Coding and CRC": "Coding and CRC.gtype"}
diagram:
  case ($"Error In") {
    frame Error {
      w1 = default
      w2 = $"Error In"
      w3 = default
    }
    frame No Error {
      Property Node(instance in=$"Demodulation parameters") -> ("PSK system parameters:samples per symbol (16)"=w4)
      # w4: » T »
      Negate(x=w4) -> w5
      Divide(x=w5, y=PiTimes2) -> w6
      # Oerder Meyr algoritm
      for (iteration -> i1) {
        w7 = each element of $"Bits in"
        Multiply(w7, w4) -> w9
        Absolute Value(x=w9) -> w10
        Square(x=w10) -> w11
        # i1: k
        Divide(x=i1, y=w4) -> w12
        Multiply(0-1i, PiTimes2) -> w13
        Multiply(w12, w13) -> w14
        Exponential(x=w14) -> w15
        Multiply(w11, w15) -> w16
        append w16 to w8
      }
      Add Array Elements(numeric array=w8) -> (sum=w17)
      Complex To Polar(r * e^(i*theta)=w17) -> (theta=w18)
      Multiply(w6, w18) -> w19
      Round To Nearest(number=w19) -> w20
      To Word Integer(number=w20) -> w3
      Complex To Real Imaginary(x + iy=w8) -> (x=w21, y=w22)
      Build Array(w21, w22) -> w23
      $Graph <- w23
      w1 = $"Bits in"
      w2 = $"Error In"
    }
  }
  $"Bits out" <- w1
  $"Timing shift" <- w3
  $"Error Out" <- w2
