vi "Timing Recovery_2.gvi"   [LabVIEW Communications System Design Software 2.0.1]
inputs:
  "Filtered waveform out": cluster{"t0": f64, "dt": f64, "Y": c128[]}
  "Demodulation parameters": "Demodulation parameters.gtype"
  "Error In": error
outputs:
  "Error array": f64[]
  "Error Out": error
  "Bits out": c128[]
  "product": c128
panel indicators:
  "Graph": f64[][]
types:
  T1 = cluster{"samples per symbol (16)": i32, "symbol map": c128[], "differential PSK": enum{"disable", "enable"}, "PSK type": enum{"normal", "shifted", "offset"}}
  "Burst Parameters.gtype" = cluster{"# Message Symbols": i32, "# Guard Symbols": i32, "Sync Bits": u16}
  "Coding and CRC.gtype" = cluster{"Rate (k/n)": enum{"1/2", "none"}, "CRC seed": u16}
  "Demodulation parameters.gtype" = cluster{"PSK system parameters": T1, "pulse shaping filter coefficients": f64[], "matched filter coefficients": f64[], "Burst Parameters": "Burst Parameters.gtype", "Coding and CRC": "Coding and CRC.gtype"}
diagram:
  case ($"Error In") {
    frame Error {
      w1 = default
      w2 = default
      w3 = $"Error In"
      w4 = default
    }
    frame No Error {
      Property Node(instance in=$"Filtered waveform out") -> ("Y"=w2, "dt"=w5)
      Property Node(instance in=$"Demodulation parameters") -> ("PSK system parameters:samples per symbol (16)"=w6)
      Multiply(w5, w6) -> w7
      # w7: » T »
      Negate(x=w7) -> w8
      Divide(x=w8, y=PiTimes2) -> w9
      # Gardner
      # f(bit)*oversampling
      for (iteration -> i1) {
        w10 = each element of w2
        Multiply(w10, w7) -> w12
        Absolute Value(x=w12) -> w13
        Square(x=w13) -> w14
        # i1: k
        Divide(x=i1, y=w6) -> w15
        Multiply(0-1i, PiTimes2) -> w16
        Multiply(w15, w16) -> w17
        Exponential(x=w17) -> w18
        Multiply(w14, w18) -> w19
        append w19 to w11
      }
      Add Array Elements(numeric array=w11) -> (sum=w20)
      Exponential(x=w20) -> w21
      Multiply(w9, w21) -> w4
      Complex To Real Imaginary(x + iy=w11) -> (x=w22, y=w23)
      Build Array(w22, w23) -> w24
      $Graph <- w24
      w1 = f64[] []
      w3 = $"Error In"
    }
  }
  $"Bits out" <- w2
  $"Error array" <- w1
  $product <- w4
  $"Error Out" <- w3
