vi "Modulation init.gvi"   [LabVIEW Communications System Design Suite 2.0.1]
inputs:
  "PSK Parameters": T1
  "Filter": "Filter.gtype" = {"Pulse shaping filter"="none", "Pulse filter parameter"=0.5, "Matched filter"="none", "Matched filter parameter"=0.5}
  "error in": error
  "Burst Parameters": "Burst Parameters.gtype" = {"# Message Symbols"=1000, "# Guard Symbols"=8, "Sync Bits"=64250}
  "Coding and CRC": "Coding and CRC.gtype" = {"Rate (k/n)"="1/2", "CRC seed"=4080}
outputs:
  "Demodulation parameters": "Demodulation parameters.gtype"
  "Modulation parameters": "Modulation parameters.gtype"
  "error out": error
panel controls:
  "Demodulation parameters_2": "Demodulation parameters.gtype"
  "Modulation parameters_2": "Modulation parameters.gtype"
panel indicators:
  "matched filter coefficients": f64[]
types:
  T1 = cluster{"samples per symbol": i32, "M-PSK": i32, "differential PSK": enum{"disable", "enable"}, "PSK type": enum{"normal", "shifted", "offset"}}
  "Burst Parameters.gtype" = cluster{"# Message Symbols": i32, "# Guard Symbols": i32, "Sync Bits": u16}
  "Coding and CRC.gtype" = cluster{"Rate (k/n)": enum{"1/2", "2/3"}, "CRC seed": u16}
  "Modulation parameters.gtype" = cluster{"PSK Parameters": T1, "pulse shaping filter coefficients": f64[], "Burst Parameters": "Burst Parameters.gtype", "Coding and CRC": "Coding and CRC.gtype"}
  T2 = cluster{"samples per symbol (16)": i32, "symbol map": c128[], "differential PSK": enum{"disable", "enable"}, "PSK type": enum{"normal", "shifted", "offset"}}
  "Demodulation parameters.gtype" = cluster{"PSK system parameters": T2, "pulse shaping filter coefficients": f64[], "matched filter coefficients": f64[], "Burst Parameters": "Burst Parameters.gtype", "Coding and CRC": "Coding and CRC.gtype"}
  T3 = enum{"none", "Raised Cosine", "Root Raised Cos", "Gaussian"}
  "Filter.gtype" = cluster{"Pulse shaping filter": T3, "Pulse filter parameter": f64, "Matched filter": T3, "Matched filter parameter": f64}
diagram:
  Property Node(instance in=$Filter) -> ("Pulse shaping filter"=w1, "Pulse filter parameter"=w2, "Matched filter"=w3, "Matched filter parameter"=w4)
  Property Node(instance in=$"PSK Parameters") -> ("PSK type"=w5, "samples per symbol"=w6, "M-PSK"=w7, "differential PSK"=w8)
  # This VI generates all the parameters for the demodulation and modulation. It was created, so the main vi's will be more readable.
  # 1. Generating filter coeffieicents for the transmitter and reciever.
  # 2. Generating PSK parameters as PSK type, amples per symbol,...
  case (w3) {
    frame "none" {
      w9 = $"error in"
      w10 = [1]
    }
    frame Default {
      # 1
      call "MT Generate Filter Coefficients.gvi"(pulse shaping filter=w3, pulse shaping samples per symbol=w6, matched samples per symbol=w6, filter parameter=w4, error in=$"error in", modulation type="PSK", filter length=8) -> (pulse shaping filter coefficients=w10, error out=w9)
    }
  }
  case (w1) {
    frame "none" {
      w11 = w9
      w12 = [1, 1, 1, 1, 1, 1, 1, 1, 1, 1, 1, 1, 1, 1, 1, 1]
    }
    frame Default {
      call "MT Generate Filter Coefficients.gvi"(pulse shaping filter=w1, pulse shaping samples per symbol=w6, matched samples per symbol=w6, filter parameter=w2, error in=w9, modulation type="PSK", filter length=8) -> (pulse shaping filter coefficients=w12, error out=w11)
    }
  }
  # 2
  call "MT Generate PSK System Parameters(M).gvi"(samples per symbol=w6, M-PSK=w7, differential PSK=w8, error in=w11, PSK type=w5) -> (PSK system parameters=w13, error out=w14)
  # Demod
  Property Node(instance in=$"Demodulation parameters_2", "PSK system parameters"=w13, "pulse shaping filter coefficients"=w12, "matched filter coefficients"=w10, "Burst Parameters"=$"Burst Parameters", "Coding and CRC"=$"Coding and CRC") -> (instance out=w15)
  $"Demodulation parameters" <- w15
  $"matched filter coefficients" <- w10
  # Mod
  Property Node(instance in=$"Modulation parameters_2", "PSK Parameters"=$"PSK Parameters", "pulse shaping filter coefficients"=w12, "Burst Parameters"=$"Burst Parameters", "Coding and CRC"=$"Coding and CRC") -> (instance out=w16)
  $"Modulation parameters" <- w16
  $"error out" <- w14
