vi "Modulation test.gvi"   [LabVIEW Communications System Design Software 2.0.1]
panel controls:
  "symbol rate": f64 = 10000
  "PSK Parameters": T2 = {"samples per symbol"=16, "M-PSK"=2, "differential PSK"="enable", "PSK type"="normal"}
  "Tab": i32
  "Burst Parameters": "Burst Parameters.gtype" = {"# Message Symbols"=1000, "# Guard Symbols"=80, "Sync Bits"=64250}
  "Filter Parameters": "Filter.gtype" = {"Transmit filter"="Root Raised Cos", "Pulse filter parameter"=0.5, "Receive filter"="Root Raised Cos", "Matched filter parameter"=0.5}
  "Coding and CRC": "Coding and CRC.gtype" = {"Rate (k/n)"="1/2", "CRC seed"=56797}
  "eb/n0": f64 = 10
  "Number of averages": i32 = 1
panel indicators:
  "Constellation": T1[]
  "Modulation": f64[]
  "Demodulation": f64[][]
  "Sync found": bool
  "CRC": u16
  "Error Out": error
  "Modulation_2": cluster{"t0": f64, "dt": f64, "Y": c128[]}[]
  "Modulation_3": cluster{"t0": f64, "dt": f64, "Y": c128[]}[]
  "Modulation_4": T4
  "Modulation_5": T4
  "Averaged BER": f64
types:
  T1 = cluster{"constellation": f64[], "oversampled data": f64[]}
  T2 = cluster{"samples per symbol": i32, "M-PSK": i32, "differential PSK": enum{"disable", "enable"}, "PSK type": enum{"normal", "shifted", "offset"}}
  "Burst Parameters.gtype" = cluster{"# Message Symbols": i32, "# Guard Symbols": i32, "Sync Bits": u16}
  T3 = enum{"none", "Raised Cosine", "Root Raised Cos", "Gaussian"}
  "Filter.gtype" = cluster{"Transmit filter": T3, "Pulse filter parameter": f64, "Receive filter": T3, "Matched filter parameter": f64}
  "Coding and CRC.gtype" = cluster{"Rate (k/n)": enum{"1/2", "2/3"}, "CRC seed": u16}
  T4 = cluster{"f0": f64, "df": f64, "magnitude": f64[]}
uses:
  NI::Analysis::Measurement::Power Spectrum for 1 Chan.gvi
diagram:
  call "Modulation init.gvi"(PSK Parameters=$"PSK Parameters", Filter=$"Filter Parameters", Burst Parameters=$"Burst Parameters", Coding and CRC=$"Coding and CRC") -> (Demodulation parameters=w1, Modulation parameters=w2, error out=w3)
  # ----------------------------------TRANSMITTER-----------------------------------------
  Property Node(instance in=$"Burst Parameters") -> ("# Message Symbols"=w4, "# Guard Symbols"=w5, "Sync Bits"=w6)
  call "Message bit generation.gvi"(# Message Symbols=w4, error in=w3) -> (Output Bit Stream=w7, error out=w8)
  Property Node(instance in=$"Coding and CRC") -> ("Rate (k/n)"=w9)
  Array Size(array=w7) -> (size(s)=w10)
  # --------INITIALIZATION------
  call "CRC.gvi"(Message In=w7, Error In=w8, Forward?=TRUE, # of MSG bits=w10) -> (Data out=w11, Error Out=w12)
  call "Convolutional Coder.gvi"(Input bitstream=w11, Rate (k/n)=w9, Error in=w12) -> (Coded bit stream=w13, Error out=w14)
  Number To Boolean Array(number=w6) -> (Boolean array=w15)
  Boolean To Integer(Boolean=w15) -> (0, 1=w16)
  To Byte Integer(number=w16) -> w17
  call "Burst Building.gvi"(Sync Bits [#16]=w17, Input bit stream=w13, error in=w14, # Guard Symbols=w5) -> (Output bit stream=w18, error out=w19)
  call "Modulation (PSK).gvi"(input bit stream=w18, Modulation parameters=w2, symbol rate=$"symbol rate", error in=w19) -> (error out=w20, output complex waveform=w21)
  call "AWGN generation.gvi"(Waveform in=w21, symbol rate=$"symbol rate", eb/n0 [dB of complex]=$"eb/n0", Error In=w20) -> (Error Out=w22, Waveform out=w23)
  call "Demodulation (PSK).gvi"(Waveform in=w23, error in=w22, Demodulation parameters=w1) -> (Messages out=w24, error out=w25, Sync found=w26, output complex waveform=w27)
  Array Size(array=w24) -> (size(s)=w28)
  Array Size(array=w28) -> (size(s)=w29)
  Is Equal To 0(x=w29) -> w30
  case (w30) {
    frame True {
      w31 = w25
      w32 = [[999]]
      w33 = i8[][] []
    }
    frame False {
      s1 = w25  # shift register
      for {
        w34 = each element of w24
        call "Convolutional Decoder.gvi"(Coding rate=w9, Coded bit stream=w34, Error in=s1) -> (Decoded bits=w35, Error Out=w36)
        call "CRC.gvi"(Message In=w35, Error In=w36, Forward?=FALSE, # of MSG bits=w10) -> (Data out=w37, CRC value=w38, Error Out=w39)
        append w38 to w32
        append w37 to w33
        next s1 = w39
      }
      w31 = s1
    }
  }
  call "BER.gvi"(Number of averages=$"Number of averages", Reference bits=w7, Input bits=w33) -> (Averaged BER=w40)
  $"Averaged BER" <- w40
  call "MT Format Constellation.gvi"(waveform=w27, samples per symbol=16) -> (constellation graph=w41)
  $Constellation <- w41
  Property Node(instance in=w27) -> ("Y"=w42)
  Complex To Real Imaginary(x + iy=w42) -> (x=w43)
  $Modulation <- w43
  To Double Precision Float(number=w7) -> w44
  To Double Precision Float(number=w33) -> w45
  Build Array[ConcatenateInputs=True](w44, w45) -> w46
  $Demodulation <- w46
  Add Array Elements(numeric array=w32) -> (sum=w47)
  $CRC <- w47
  call "Display Error.gvi"(error in=w31)
  $"Error Out" <- w31
  $"Sync found" <- w26
  # -------------------------------------RECIEVER------------------------------------
  Build Array(w23, w23) -> w48
  $Modulation_3 <- w48
  Property Node(instance in=$"PSK Parameters") -> ("samples per symbol"=w49)
  call "MT Add AWGN.gvi"(input complex waveform=w23, samples per symbol=w49, eb/n0=$"eb/n0") -> (output complex waveform=w50)
  Build Array(w23, w50) -> w51
  $Modulation_2 <- w51
  Property Node(instance in=w50) -> ("Y"=w52, "dt"=w53)
  call "Power Spectrum for 1 Chan.gvi"(signal=w52, dB on=TRUE, window parameter=w53) -> (power spectrum=w54)
  $Modulation_4 <- w54
  Property Node(instance in=w23) -> ("Y"=w55)
  call "Power Spectrum for 1 Chan.gvi"(signal=w55, dB on=TRUE, window parameter=w53) -> (power spectrum=w56)
  $Modulation_5 <- w56
