vi "Differencial logic.gvi"   [LabVIEW Communications System Design Software 2.0.1]
inputs:
  "Burst bits in": i8[]
  "Error In": error
outputs:
  "Bits out": c128[]
  "Error Out": error
diagram:
  case ($"Error In") {
    frame Error {
      w1 = default
      w2 = $"Error In"
    }
    frame No Error {
      for {
        w3 = each element of $"Burst bits in"
        Is Equal(x=w3, y=1) -> w4
        Feedback Node(initial value=0, input=w5) -> w6
        case (w4) {
          frame False, Default {
            w5 = w6
          }
          frame True {
            Add(w6, Pi) -> w5
          }
        }
        Polar To Complex(r=1, theta=w5) -> (r * e^(i*theta)=w7)
        append w7 to w1
      }
      w2 = $"Error In"
    }
  }
  $"Bits out" <- w1
  $"Error Out" <- w2
  disable {
    frame Enabled { }
    frame Disabled {
      for {
        Is Equal(x=w8, y=1) -> w9
        Feedback Node(initial value=1+0i, input=w10) -> w11
        case (w9) {
          frame False, Default {
            w10 = w11
          }
          frame True {
            Negate(x=w11) -> w10
          }
        }
      }
    }
  }
