vi "Pulse Shaping Filter.gvi"   [LabVIEW Communications System Design Software 2.0.1]
inputs:
  "Bits in": c128[]
  "Filter Coefficients": f64[]
  "Symbol Rate [Hz]": f64
  "Error in": error
  "Samples per Symbol": i32
outputs:
  "Modulated bits out": c128[]
  "Modulated waveform out": cluster{"t0": f64, "dt": f64, "Y": c128[]}
  "Error out": error
panel indicators:
  "Graph": f64[][]
types:
  "filter structure.gtype" = u32
  "filter.gtype" = cluster{"filter structure": "filter structure.gtype", "forward coefficients": f64[], "reverse coefficients": f64[], "sampling frequency": f64}
uses:
  NI::Analysis::Filtering::Filtering (CDB).gvi
diagram:
  case ($"Error in") {
    frame Error {
      w1 = $"Bits in"
      w2 = default
      w3 = $"Error in"
    }
    frame No Error {
      w4 = cluster{"t0": f64, "dt": f64, "Y": c128[]} {all zero or empty}
      Array Size(array=$"Filter Coefficients") -> (size(s)=w5)
      Multiply(w5, 1) -> w6
      w7 = "filter.gtype" {"filter structure"=3, "forward coefficients"=[], "reverse coefficients"=[], "sampling frequency"=0}
      Property Node(instance in=w7, "forward coefficients"=$"Filter Coefficients") -> (instance out=w8)
      Array Subset(array=$"Bits in", index0=0, length0=w6) -> w9
      Build Array[ConcatenateInputs=True](w9, $"Bits in") -> w10
      call "Filtering (CDB).gvi"(signal=w10, filter=w8, error in=$"Error in") -> (filtered signal=w11, error out=w3)
      Delete From Array(inArray=w11, length (1)=w6, index0=0) -> w1
      Multiply($"Samples per Symbol", $"Symbol Rate [Hz]") -> w12
      Reciprocal(x=w12) -> w13
      Property Node(instance in=w4, "dt"=w13, "Y"=w1) -> (instance out=w2)
      Initialize Array(element=0.075+0i, size=w6)
      Initialize Array(element=w6)
    }
  }
  $"Modulated bits out" <- w1
  $"Modulated waveform out" <- w2
  $"Error out" <- w3
  Complex To Polar(r * e^(i*theta)=w1) -> (r=w14)
  case ($"Error in") {
    frame Error {
      w15 = $"Bits in"
    }
    frame No Error {
      Array Size(array=$"Filter Coefficients") -> (size(s)=w16)
      Multiply(w16, 1) -> w17
      Initialize Array(element=0.05+0i, size=w17) -> w18
      Build Array[ConcatenateInputs=True](w18, $"Bits in")
      w19 = "filter.gtype" {"filter structure"=3, "forward coefficients"=[], "reverse coefficients"=[], "sampling frequency"=0}
      Property Node(instance in=w19, "forward coefficients"=$"Filter Coefficients") -> (instance out=w20)
      call "Filtering (CDB).gvi"(signal=$"Bits in", filter=w20, error in=$"Error in") -> (filtered signal=w15, error out=w21)
      Delete From Array(inArray=w15, length (1)=w17, index0=3)
      w22 = cluster{"t0": f64, "dt": f64, "Y": c128[]} {all zero or empty}
      Multiply($"Samples per Symbol", $"Symbol Rate [Hz]") -> w23
      Reciprocal(x=w23) -> w24
      Property Node(instance in=w22, "dt"=w24, "Y"=w15) -> (instance out=w25)
    }
  }
  Complex To Polar(r * e^(i*theta)=w15) -> (r=w26)
  Build Array(w14, w26) -> w27
  $Graph <- w27
