vi "Zero insertion.gvi"   [LabVIEW Communications System Design Suite 2.0.1]
inputs:
  "Bits in": c128[]
  "Samples per symbols": i32
  "Error In": error
outputs:
  "Bits out": c128[]
  "Error Out": error
diagram:
  case ($"Error In") {
    frame Error {
      w1 = $"Bits in"
      w2 = $"Error In"
    }
    frame No Error {
      for {
        w3 = each element of $"Bits in"
        for (N = $"Samples per symbols") (iteration -> i1) {
          Is Equal To 0(x=i1) -> w5
          Select(s=w5, t=w3, f=0+0i) -> w6
          append w6 to w4
        }
        concatenate w4 onto w1
      }
      w2 = $"Error In"
    }
  }
  $"Bits out" <- w1
  $"Error Out" <- w2
