vi "Rx data processing.gvi"   [LabVIEW Communications System Design Suite 2.0.1]
inputs:
  "Data": T2 = {"Modulated Waveform"={"t0"=0, "dt"=1, "Y"=[]}, "Output Bit Stream"=[]}
  "Demodulation paremeters": "Demodulation parameters.gtype" = {"PSK system parameters"={"samples per symbol (16)"=16, "symbol map"=[], "differential PSK"="disable", "PSK type"="normal"}, "pulse shaping filter coefficients"=[], "matched filter coefficients"=[], "Burst Parameters"={"# Message Symbols"=1000, "# Guard Symbols"=8, "Sync Bits"=64250}, "Coding and CRC"={"Rate (k/n)"="1/2", "CRC seed"=0}}
  "error in": error
  "Block selection": T1 = "Raw data"
outputs:
  "error out": error
  "Sync found": bool
  "Decoded bitstream array": i8[][]
  "CRC value (out) array": u16[][]
  "Recieved waveform (filtered)": cluster{"t0": f64, "dt": f64, "Y": c128[]}
types:
  T1 = enum{"Raw data", "Raw data+CRC", "Raw data+CRC+Coding", "Raw data+CRC+Coding+Modulation"}
  T2 = cluster{"Modulated Waveform": cluster{"t0": f64, "dt": f64, "Y": c128[]}, "Output Bit Stream": i8[]}
  T3 = cluster{"samples per symbol (16)": i32, "symbol map": c128[], "differential PSK": enum{"disable", "enable"}, "PSK type": enum{"normal", "shifted", "offset"}}
  "Burst Parameters.gtype" = cluster{"# Message Symbols": i32, "# Guard Symbols": i32, "Sync Bits": u16}
  "Coding and CRC.gtype" = cluster{"Rate (k/n)": enum{"1/2", "2/3"}, "CRC seed": u16}
  "Demodulation parameters.gtype" = cluster{"PSK system parameters": T3, "pulse shaping filter coefficients": f64[], "matched filter coefficients": f64[], "Burst Parameters": "Burst Parameters.gtype", "Coding and CRC": "Coding and CRC.gtype"}
diagram:
  Property Node(instance in=$Data) -> ("Modulated Waveform"=w1, "Output Bit Stream"=w2)
  case ($"error in") {
    frame No Error, Default {
      case ($"Block selection") {
        frame "Raw data" {
          Build Array(w2) -> w6
          w3 = $"error in"
          w4 = default
          w5 = w1
          w7 = default
        }
        frame "Raw data+CRC" {
          Property Node(instance in=$"Demodulation paremeters") -> ("Coding and CRC:CRC seed"=w8, "Burst Parameters:# Message Symbols"=w9)
          call "CRC.gvi"(Message In=w2, CRC seed=w8, Error In=$"error in", Forward?=FALSE, # of MSG bits=w9) -> (Data out=w10, CRC value=w11, Error Out=w3)
          Build Array(w10) -> w6
          Build Array(w11) -> w7
          w4 = default
          w5 = w1
        }
        frame "Raw data+CRC+Coding" {
          Property Node(instance in=$"Demodulation paremeters") -> ("Burst Parameters:# Message Symbols"=w12, "Coding and CRC:CRC seed"=w13, "Coding and CRC:Rate (k/n)"=w14)
          call "Convolutional Decoder.gvi"(Coding rate=w14, Coded bit stream=w2, Error in=$"error in") -> (Decoded bits=w15, Error Out=w16)
          call "CRC.gvi"(Message In=w15, CRC seed=w13, Error In=w16, Forward?=FALSE, # of MSG bits=w12) -> (Data out=w17, CRC value=w18, Error Out=w3)
          Build Array(w17) -> w6
          Build Array(w18) -> w7
          w4 = default
          w5 = w1
        }
        frame "Raw data+CRC+Coding+Modulation", Default {
          Property Node(instance in=$"Demodulation paremeters") -> ("Coding and CRC:CRC seed"=w19, "Coding and CRC:Rate (k/n)"=w20, "Burst Parameters:# Message Symbols"=w21)
          call "Demodulation (PSK).gvi"(Waveform in=w1, error in=$"error in", Demodulation parameters=$"Demodulation paremeters") -> (Messages out=w22, error out=w23, Sync found=w4, output complex waveform=w5)
          s1 = w23  # shift register
          for {
            w24 = each element of w22
            call "Convolutional Decoder.gvi"(Coding rate=w20, Coded bit stream=w24, Error in=s1) -> (Decoded bits=w25, Error Out=w26)
            call "CRC.gvi"(Message In=w25, CRC seed=w19, Error In=w26, Forward?=FALSE, # of MSG bits=w21) -> (Data out=w27, CRC value=w28, Error Out=w29)
            append w28 to w7
            append w27 to w6
            next s1 = w29
          }
          w3 = s1
        }
      }
    }
    frame Error {
      w3 = $"error in"
      w4 = default
      w5 = default
      w6 = default
      w7 = default
    }
  }
  $"Recieved waveform (filtered)" <- w5
  $"Decoded bitstream array" <- w6
  $"CRC value (out) array" <- w7
  $"error out" <- w3
  $"Sync found" <- w4
