vi "Tx data processing.gvi"   [LabVIEW Communications System Design Software 2.0.1]
inputs:
  "error in": error
  "Block selection": T1 = "Raw data"
  "Modulation parameters": "Modulation parameters.gtype"
  "symbol rate (baud)": f64 = 10000
outputs:
  "Data": T2
  "Output Bit Stream": i8[]
  "error out": error
panel controls:
  "Tab": i32 = 1
types:
  T1 = enum{"Raw data", "Raw data+CRC", "Raw data+CRC+Coding", "Raw data+CRC+Coding+Modulation"}
  T2 = cluster{"Modulated Waveform": cluster{"t0": f64, "dt": f64, "Y": c128[]}, "Output Bit Stream": i8[]}
  T3 = cluster{"samples per symbol": i32, "M-PSK": i32, "differential PSK": enum{"disable", "enable"}, "PSK type": enum{"normal", "shifted", "offset"}}
  "Burst Parameters.gtype" = cluster{"# Message Symbols": i32, "# Guard Symbols": i32, "Sync Bits": u16}
  "Coding and CRC.gtype" = cluster{"Rate (k/n)": enum{"1/2", "2/3"}, "CRC seed": u16}
  "Modulation parameters.gtype" = cluster{"PSK Parameters": T3, "pulse shaping filter coefficients": f64[], "Burst Parameters": "Burst Parameters.gtype", "Coding and CRC": "Coding and CRC.gtype"}
diagram:
  Property Node(instance in=$"Modulation parameters") -> ("Burst Parameters"=w1, "PSK Parameters"=w2, "Burst Parameters:Sync Bits"=w3, "Coding and CRC"=w4, "pulse shaping filter coefficients"=w5, "Burst Parameters:# Message Symbols"=w6, instance out=w7)
  Property Node(instance in=w4) -> ("Rate (k/n)"=w8, "CRC seed"=w9)
  Number To Boolean Array(number=w3) -> (Boolean array=w10)
  Boolean To Integer(Boolean=w10) -> (0, 1=w11)
  To Byte Integer(number=w11) -> w12
  case ($"error in") {
    frame Error {
      w13 = $"error in"
      w14 = default
      w15 = default
      w16 = default
    }
    frame No Error, Default {
      case ($"Block selection") {
        frame "Raw data" {
          Property Node(instance in=w2) -> ("samples per symbol"=w17)
          Property Node(instance in=w1) -> ("# Message Symbols"=w18)
          call "Message bit generation.gvi"(# Message Symbols=w18, error in=$"error in") -> (Output Bit Stream=w15, error out=w19)
          To Double Precision Complex(number=w15) -> w20
          call "MT Apply Pulse Shaping Filter (Generic).gvi"(symbols=w20, pulse shaping filter coefficients=w5, samples per symbol=w17, symbol rate=$"symbol rate (baud)", error in=w19) -> (output complex waveform=w14, error out=w13)
          w16 = w15
        }
        frame "Raw data+CRC" {
          Property Node(instance in=w2) -> ("samples per symbol"=w21)
          Property Node(instance in=w1) -> ("# Message Symbols"=w22)
          call "Message bit generation.gvi"(# Message Symbols=w22, error in=$"error in") -> (Output Bit Stream=w16, error out=w23)
          call "CRC.gvi"(Message In=w16, CRC seed=w9, Error In=w23, Forward?=TRUE) -> (Data out=w15, Error Out=w24)
          To Double Precision Complex(number=w15) -> w25
          call "MT Apply Pulse Shaping Filter (Generic).gvi"(symbols=w25, pulse shaping filter coefficients=w5, samples per symbol=w21, symbol rate=$"symbol rate (baud)", error in=w24) -> (output complex waveform=w14, error out=w13)
        }
        frame "Raw data+CRC+Coding" {
          Property Node(instance in=w2) -> ("samples per symbol"=w26)
          Property Node(instance in=w1) -> ("# Message Symbols"=w27)
          call "Message bit generation.gvi"(# Message Symbols=w27, error in=$"error in") -> (Output Bit Stream=w16, error out=w28)
          call "CRC.gvi"(Message In=w16, CRC seed=w9, Error In=w28, Forward?=TRUE) -> (Data out=w29, Error Out=w30)
          call "Convolutional Coder.gvi"(Input bitstream=w29, Rate (k/n)=w8, Error in=w30) -> (Coded bit stream=w15, Error out=w31)
          To Double Precision Complex(number=w15) -> w32
          call "MT Apply Pulse Shaping Filter (Generic).gvi"(symbols=w32, pulse shaping filter coefficients=w5, samples per symbol=w26, symbol rate=$"symbol rate (baud)", error in=w31) -> (output complex waveform=w14, error out=w13)
        }
        frame "Raw data+CRC+Coding+Modulation", Default {
          Property Node(instance in=w1) -> ("# Message Symbols"=w33, instance out=w34)
          # 1
          call "Message bit generation.gvi"(# Message Symbols=w33, error in=$"error in") -> (Output Bit Stream=w16, error out=w35)
          # 2.
          call "CRC.gvi"(Message In=w16, CRC seed=w9, Error In=w35, Forward?=TRUE, # of MSG bits=w6) -> (Data out=w36, Error Out=w37)
          # 3.
          call "Convolutional Coder.gvi"(Input bitstream=w36, Rate (k/n)=w8, Error in=w37) -> (Coded bit stream=w38, Error out=w39)
          Property Node(instance in=w34) -> ("# Guard Symbols"=w40)
          # 4.
          call "Burst Building.gvi"(Sync Bits [#16]=w12, Input bit stream=w38, error in=w39, # Guard Symbols=w40) -> (Output bit stream=w15, error out=w41)
          # 5.
          call "Modulation (PSK).gvi"(input bit stream=w15, Modulation parameters=w7, symbol rate=$"symbol rate (baud)", error in=w41) -> (error out=w13, output complex waveform=w14)
        }
      }
    }
  }
  Build Cluster(w14, w15) -> w42
  $Data <- w42
  $"error out" <- w13
  $"Output Bit Stream" <- w16
