vi "Sync search2.gvi"   [LabVIEW Communications System Design Software 2.0.1]
inputs:
  "Bits in": i8[]
  "Sync bits": u16
  "Burst Parameters:# Message Symbols": i32
outputs:
  "Array_2": i8[][]
diagram:
  for {
    w1 = each element of $"Bits in"
    To Double Precision Float(number=w1) -> w3
    Subtract(x=w3, y=0.5) -> w4
    Number To Boolean Array(number=$"Sync bits") -> (Boolean array=w5)
    Boolean To Integer(Boolean=w5) -> (0, 1=w6)
    To Double Precision Float(number=w6) -> w7
    Subtract(x=w7, y=0.5) -> w8
    Array Index(array=w8) -> (out0[_]=w9, out1[_]=w10, out2[_]=w11, out3[_]=w12, out4[_]=w13, out5[_]=w14, out6[_]=w15, out7[_]=w16, out8[_]=w17, out9[_]=w18, out10[_]=w19, out11[_]=w20, out12[_]=w21, out13[_]=w22, out14[_]=w23, out15[_]=w24)
    Multiply(w4, w9) -> w25
    Feedback Node(input=w3) -> w26
    Multiply(w26, w10) -> w27
    Feedback Node(input=w26) -> w28
    Multiply(w28, w11) -> w29
    Feedback Node(input=w28) -> w30
    Multiply(w30, w12) -> w31
    Feedback Node(input=w30) -> w32
    Multiply(w32, w13) -> w33
    Feedback Node(input=w32) -> w34
    Multiply(w34, w14) -> w35
    Feedback Node(input=w34) -> w36
    Multiply(w36, w15) -> w37
    Feedback Node(input=w36) -> w38
    Multiply(w38, w16) -> w39
    Feedback Node(input=w38) -> w40
    Multiply(w40, w17) -> w41
    Feedback Node(input=w40) -> w42
    Multiply(w42, w18) -> w43
    Feedback Node(input=w42) -> w44
    Multiply(w44, w19) -> w45
    Feedback Node(input=w44) -> w46
    Multiply(w46, w20) -> w47
    Feedback Node(input=w46) -> w48
    Multiply(w48, w21) -> w49
    Feedback Node(input=w48) -> w50
    Multiply(w50, w22) -> w51
    Feedback Node(input=w50) -> w52
    Multiply(w52, w23) -> w53
    Feedback Node(input=w52) -> w54
    Multiply(w54, w24) -> w55
    Add(w55, w53, w51, w49, w47, w45, w43, w41, w39, w37, w35, w33, w31, w29, w27, w25) -> w56
    append w56 to w2
  }
  Array Max And Min(array=w2) -> (max index(es)=w57)
  Add(w57, 2) -> w58
  for (N = 1) {
    Delete From Array(inArray=$"Bits in", length (1)=$"Burst Parameters:# Message Symbols", index0=w58) -> (deleted=w60)
    append w60 to w59
  }
  $Array_2 <- w59
