vi "Sync search_2.gvi"   [LabVIEW Communications System Design Software 2.0.1]
inputs:
  "Bit in": i8
  "Sync bits": u16
  "Burst Parameters:# Message Symbols": i32
  "Reset?": bool
outputs:
  "output ready?": bool
  "Sync found": bool
  "Message out": i8[]
diagram:
  # $"Sync bits": Syin bits
  # $"Burst Parameters:# Message Symbols": # MSG bits
  Number To Boolean Array(number=$"Sync bits") -> (Boolean array=w1)
  Boolean To Integer(Boolean=w1) -> (0, 1=w2)
  To Byte Integer(number=w2) -> w3
  s1 = uninitialised  # shift register
  s2 = uninitialised  # shift register
  s3 = uninitialised  # shift register
  s4 = $"Bit in"  # shift register
  s5 = uninitialised  # shift register
  s6 = uninitialised  # shift register
  while {
    Select(s=$"Reset?", t="First run", f=s1) -> w4
    case (w4) {
      frame "Sync search", Default {
        Replace Array Subset(inArray=s5, index=0, new=s4) -> w12
        Rotate 1D Array(array=w12, n=1) -> (array (last n elements first)=w5)
        Logical Exclusive Or(w3, w12) -> w13
        Add Array Elements(numeric array=w13) -> (sum=w14)
        Is Less Or Equal(x=w14, y=3) -> w9
        Select(s=w9, t="Get message", f="Sync search") -> w6
        w7 = 0
        w8 = i8[] []
        w10 = s4
        w11 = FALSE
      }
      frame "Get message" {
        Build Array[ConcatenateInputs=True](s4, s3) -> w8
        Initialize Array(element=0, size=16) -> w5
        Increment(x=s2) -> w7
        Is Less(x=w7, y=$"Burst Parameters:# Message Symbols") -> w15
        Select(s=w15, t="Get message", f="Sync search") -> w6
        Not(x=w15) -> w11
        w9 = FALSE
        w10 = s4
      }
      frame "First run" {
        Initialize Array(element=0, size=16) -> w5
        w6 = "Sync search"
        w7 = 0
        w8 = i8[] []
        w9 = FALSE
        w10 = 0
        w11 = FALSE
      }
    }
    next s1 = w6
    next s2 = w7
    next s3 = w8
    next s4 = w10
    next s5 = w5
    next s6 = w9
    stop if TRUE
  }
  $"Message out" <- s3
  $"Sync found" <- s6
  $"output ready?" <- w11
