vi "sync_try.gvi"   [LabVIEW Communications System Design Software 2.0.1]
panel controls:
  "Rotate": bool
  "Number": u16
  "Number_2": u16
panel indicators:
  "XOR": u32
  "AND": u32
  "XOR sum": i16
  "AND sum": i16
  "Graph": i16[][]
  "XOR?": u32
diagram:
  w1 = $Number
  case ($Rotate) {
    frame True {
      s1 = 0  # shift register
      for (N = 18) {
        Increment(x=s1) -> w9
        Number To Boolean Array(number=w1) -> (Boolean array=w10)
        Rotate 1D Array(array=w10, n=s1) -> (array (last n elements first)=w11)
        Logical Exclusive Or(w10, w11) -> w12
        Boolean Array To Number(Boolean array=w12) -> (number=w3)
        Logical And(w10, w11) -> w13
        Boolean Array To Number(Boolean array=w13) -> (number=w4)
        for {
          w14 = each element of w12
          w15 = each element of w13
          Boolean To Integer(Boolean=w14) -> (0, 1=w18)
          Boolean To Integer(Boolean=w15) -> (0, 1=w19)
          append w18 to w16
          append w19 to w17
        }
        Add Array Elements(numeric array=w16) -> (sum=w5)
        Add Array Elements(numeric array=w17) -> (sum=w6)
        append w5 to w7
        append w6 to w8
        next s1 = w9
      }
      Build Array(w7, w8) -> w2
    }
    frame False, Default {
      Number To Boolean Array(number=w1) -> (Boolean array=w20)
      Number To Boolean Array(number=$Number_2) -> (Boolean array=w21)
      Logical Exclusive Or(w20, w21) -> w22
      # XRO faszának tűnik, a visszatérés értéke egy arraynek a bibás bitek száma.
      # ezt ablakozva, és határértéket tartva...2-3 bit?
      Logical Exclusive Or(w20, w22) -> w23
      Boolean Array To Number(Boolean array=w23) -> (number=w3)
      Logical And(w20, w22) -> w24
      Boolean Array To Number(Boolean array=w24) -> (number=w4)
      for {
        w25 = each element of w23
        w26 = each element of w24
        Boolean To Integer(Boolean=w25) -> (0, 1=w29)
        Boolean To Integer(Boolean=w26) -> (0, 1=w30)
        append w29 to w27
        append w30 to w28
      }
      Add Array Elements(numeric array=w27) -> (sum=w5)
      Add Array Elements(numeric array=w28) -> (sum=w6)
      Build Array(w5, w6)
      Boolean Array To Number(Boolean array=w22) -> (number=w31)
      $"XOR?" <- w31
      w2 = default
    }
  }
  $XOR <- w3
  $AND <- w4
  $Graph <- w2
  $"XOR sum" <- w5
  $"AND sum" <- w6
