vi "yxc.gvi"   [LabVIEW Communications System Design Software 2.0.1]
inputs:
  "Burst Parameters:# Message Symbols": i32
  "Coding and CRC:Rate (k/n)": enum{"1/2", "2/3"} = "1/2"
  "Sync bits": u32
panel controls:
  "Sync": enum{"Sync search", "Get message"} = "Sync search"
  "Bit in": i8
panel indicators:
  "Sync found": bool
  "Index found": i32
diagram:
  # To Do:
  # Reset
  # Timeout
  # 8
  # 9
  for {
    case ($"Coding and CRC:Rate (k/n)") {
      frame "1/2", Default {
        w1 = 2
        w2 = 7
      }
      frame "2/3" {
        w1 = default
        w2 = default
      }
    }
    # $"Burst Parameters:# Message Symbols": # MSG bits
    # $"Sync bits": Syin bits
    Add($"Burst Parameters:# Message Symbols", 16) -> w3
    Add(w3, w2) -> w4
    Multiply(w4, w1) -> w5
    Number To Boolean Array(number=$"Sync bits") -> (Boolean array=w6)
    Boolean To Integer(Boolean=w6) -> (0, 1=w7)
    To Byte Integer(number=w7) -> w8
    s1 = $Sync  # shift register
    s2 = 0  # shift register
    s3 = i8[] []  # shift register
    s4 = $"Bit in"  # shift register
    s5 = 0  # shift register
    s6 = uninitialised  # shift register
    s7 = uninitialised  # shift register
    while (iteration -> i1) {
      case (s1) {
        frame "Sync search", Default {
          Array Size(array=w8) -> (size(s)=w17)
          Array Index(array=w8) -> (out0[s5]=w18)
          Is Equal(x=s4, y=w18) -> w19
          case (w19) {
            frame True {
              Increment(x=s5) -> w9
            }
            frame False {
              w9 = 0
            }
          }
          Is Equal(x=w9, y=w17) -> w15
          case (w15) {
            frame False, Default {
              Increment(x=s2) -> w12
              w13 = -1
            }
            frame True {
              Subtract(x=s2, y=w17) -> w13
              w12 = 0
            }
          }
          Select(s=w15, t="Get message", f="Sync search") -> w11
          Is Greater(x=i1, y=100000) -> w10
          w14 = i8[] []
          w16 = s4
        }
        frame "Get message" {
          Increment(x=s2) -> w12
          Build Array[ConcatenateInputs=True](s4, s3) -> w14
          Is Equal(x=s2, y=w5) -> w10
          Select(s=w10, t="Sync search", f="Get message") -> w11
          w9 = 0
          w13 = s6
          w15 = s7
          w16 = _
        }
      }
      next s1 = w11
      next s2 = w12
      next s3 = w14
      next s4 = w16
      next s5 = w9
      next s6 = w13
      next s7 = w15
      stop if w10
    }
    $"Index found" <- s6
    $"Sync found" <- s7
  }
