vi "PN settings.gvi"   [LabVIEW Communications System Design Suite 2.0.1]
inputs:
  "PSK system parameters": T1
  "PN Sequence order": i32
  "Filter Length": i32
  "Error in": error
outputs:
  "Error out": error
  "Delete length": i32
  "Total bits": i32
types:
  T1 = cluster{"samples per symbol (16)": i32, "symbol map": c128[], "differential PSK": enum{"disable", "enable"}, "PSK type": enum{"normal", "shifted", "offset"}}
diagram:
  case ($"Error in") {
    frame Error {
      w1 = $"Error in"
      w2 = default
      w3 = default
    }
    frame No Error, Default {
      Property Node(instance in=$"PSK system parameters") -> ("PSK type"=w4, "symbol map"=w5, "samples per symbol (16)"=w6)
      Math Node("x"=$"PN Sequence order") -> ("x"=w7)
      ~~~
      x=2^x-1
      ~~~
      Array Size(array=w5) -> (size(s)=w8)
      Logarithm Base 2(x=w8) -> w9
      To Long Integer(number=w9) -> w10
      case (w4) {
        frame "normal", Default {
          w11 = 0
        }
        frame "shifted" {
          Increment(x=w10) -> w11
        }
      }
      Logical Shift(x=w7, y=w11) -> w12
      Multiply(w6, w12) -> w3
      Add(w12, $"Filter Length") -> w13
      Multiply(w10, w13) -> w2
      w1 = $"Error in"
    }
  }
  $"Delete length" <- w3
  $"Total bits" <- w2
  $"Error out" <- w1
