vi "Sync search.gvi"   [LabVIEW Communications System Design Suite 2.0.1]
inputs:
  "Bits in": i8[]
  "Sync bits": u16
  "Burst Parameters:# Message Symbols": i32
  "Error In": error
outputs:
  "Sync found": bool
  "Messages out": i8[][]
  "Error Out": error
diagram:
  # Searching for the sync sequence.
  #  Deleting the rest of the array (sync bits, guatd bits + ones appended in the second step) and only keep the message.
  case ($"Error In") {
    frame Error {
      w1 = default
      w2 = $"Error In"
      w3 = default
    }
    frame No Error {
      for (iteration -> i1) {
        w4 = each element of $"Bits in"
        Is Equal To 0(x=i1) -> w6
        Number To Boolean Array(number=$"Sync bits") -> (Boolean array=w7)
        Boolean To Integer(Boolean=w7) -> (0, 1=w8)
        To Byte Integer(number=w8) -> w9
        s1 = uninitialised  # shift register
        s2 = uninitialised  # shift register
        s3 = uninitialised  # shift register
        s4 = w4  # shift register
        s5 = uninitialised  # shift register
        s6 = uninitialised  # shift register
        while {
          # s2: MSG counter
          # s4: burst bits
          # w9: sync bits
          # s5: sync counter
          case (s1) {
            frame "Sync search", Default {
              # ------------1-----------
              Array Size(array=w9) -> (size(s)=w17)
              Array Index(array=w9) -> (out0[s5]=w18)
              Is Equal(x=s4, y=w18) -> w19
              case (w19) {
                frame True {
                  Increment(x=s5) -> w10
                }
                frame False {
                  w10 = 0
                }
              }
              Is Equal(x=w10, y=w17) -> w14
              # -------------2-----------
              Select(s=w14, t="Get message", f="Sync search") -> w11
              w12 = 0
              w13 = i8[] []
              w15 = s4
              w16 = default
            }
            frame "Get message" {
              Build Array[ConcatenateInputs=True](s3, s4) -> w13
              Increment(x=s2) -> w12
              Is Less(x=w12, y=$"Burst Parameters:# Message Symbols") -> w20
              Not(x=w20) -> w16
              # ---3---
              # ---4---
              Select(s=w20, t="Get message", f="Sync search") -> w11
              w10 = 0
              w14 = FALSE
              w15 = s4
            }
          }
          # $"Burst Parameters:# Message Symbols": # of MSG bits
          Select(s=w6, t="Sync search", f=s1)
          next s1 = w11
          next s2 = w12
          next s3 = w13
          next s4 = w15
          next s5 = w10
          next s6 = w14
          stop if TRUE
        }
        Feedback Node(initial value=FALSE, input=w1) -> w21
        Select(s=w6, t=FALSE, f=w21) -> w22
        Logical Or(s6, w22) -> w1
        append s3 to w5 if w16
      }
      Is Empty Array(array=w5) -> w23
      case (w23) {
        frame False, Default {
          w3 = w5
          w2 = $"Error In"
        }
        frame True {
          call "Build Error Cluster.gvi"(code=-1, description="Sync failed", error in=$"Error In", make warning=TRUE) -> (error out=w2)
          w3 = w5
        }
      }
    }
  }
  $"Messages out" <- w3
  $"Sync found" <- w1
  $"Error Out" <- w2
