vi "diagram.gvi"   [LabVIEW Communications System Design Software 2.0.1]
panel controls:
  "Stop": bool
diagram:
  # 1
  # 2
  # 3
  # 4
  # 5
  while {
    call "Modulation init.gvi"() -> (error out=w1)
    call "Tx data processing.gvi"(error in=w1) -> (error out=w2)
    call "MT Add AWGN.gvi"(error in=w2) -> (error out=w3)
    call "Rx data processing.gvi"(error in=w3) -> (error out=w4)
    call "MT Format Constellation.gvi"(error in=w4)
    stop if $Stop
  }
