vi "Transmitter.gvi"   [LabVIEW Communications System Design Suite 2.0.1]
panel controls:
  "IQ Sampling Rate [S/sec]": f64 = 200000
  "Carrier Frequency [Hz]": f64 = 915000000
  "Gain [dB]": f64
  "Stop": bool
  "Active Antenna": i32 = "TX1"(0)
  "Enabled Channel": string = "0"
  "Device ID": "niUSRPClass" = "10.92.7.152"
  "Coding and CRC": "Coding and CRC.gtype" = {"Rate (k/n)"="1/2", "CRC seed"=56797}
  "Burst parameters": "Burst Parameters.gtype" = {"# Message Symbols"=1000, "# Guard Symbols"=80, "Sync Bits"=64250}
  "Filter": "Filter.gtype" = {"Pulse shaping filter"="Root Raised Cos", "Pulse filter parameter"=0.5, "Matched filter"="Root Raised Cos", "Matched filter parameter"=0.5}
panel indicators:
  "IQ Sampling Rate [S/sec] (actual)": f64
  "Carrier Frequency [Hz] (actual)": f64
  "Gain [dB] (actual)": f64
  "Graph": cluster{"t0": f64, "dt": f64, "Y": c128[]}
types:
  "Coding and CRC.gtype" = cluster{"Rate (k/n)": enum{"1/2", "2/3"}, "CRC seed": u16}
  "Burst Parameters.gtype" = cluster{"# Message Symbols": i32, "# Guard Symbols": i32, "Sync Bits": u16}
  T1 = enum{"none", "Raised Cosine", "Root Raised Cos", "Gaussian"}
  "Filter.gtype" = cluster{"Pulse shaping filter": T1, "Pulse filter parameter": f64, "Matched filter": T1, "Matched filter parameter": f64}
  T2 = cluster{"samples per symbol": i32, "M-PSK": i32, "differential PSK": enum{"disable", "enable"}, "PSK type": enum{"normal", "shifted", "offset"}}
diagram:
  w1 = $"Enabled Channel"
  w2 = $"IQ Sampling Rate [S/sec]"
  call "niUSRP Open Tx Session.gvi"(device names=$"Device ID", reset=TRUE) -> (session handle out=w3, error out=w4)
  Property Node(instance in=w3, "Enabled Channels"=w1, error in=w4) -> (error out=w5, instance out=w6)
  Array Index(array=["TX1", "TX2"]) -> (out0[$"Active Antenna"]=w7)
  call "niUSRP Configure Signal.gvi"(session handle=w6, IQ rate=w2, carrier frequency=$"Carrier Frequency [Hz]", gain=$"Gain [dB]", error in=w5, channel list=w1, active antenna=w7) -> (session handle out=w8, coerced IQ rate=w9, coerced carrier frequency=w10, coerced gain=w11, error out=w12)
  w13 = T2 {"samples per symbol"=16, "M-PSK"=2, "differential PSK"="enable", "PSK type"="normal"}
  call "Modulation init.gvi"(PSK Parameters=w13, Filter=$Filter, error in=w12, Burst Parameters=$"Burst parameters", Coding and CRC=$"Coding and CRC") -> (Modulation parameters=w14, error out=w15)
  s1 = w15  # shift register
  while {
    call "Tx data processing.gvi"(error in=s1, Block selection="Raw data+CRC+Coding+Modulation", Modulation parameters=w14, symbol rate (baud)=w2) -> (Data=w16, error out=w17)
    Property Node(instance in=w16) -> ("Modulated Waveform"=w18)
    Property Node(instance in=w18) -> ("Y"=w19, instance out=w20)
    Complex To Real Imaginary(x + iy=w19) -> (x=w21, y=w22)
    Real And Imaginary To Complex(x=w22, y=w21) -> w23
    Property Node(instance in=w20, "Y"=w23) -> (instance out=w24)
    $Graph <- w24
    call "niUSRP Write Tx Data (CDB Cluster).gvi"(session handle=w8, data=w18, end of data?=$Stop, error in=w17, channel list=w1) -> (session handle out=w25, error out=w26)
    call "Filter Error Code.gvi"(code to clear=-1074118641, error in=w26) -> (error out=w27)
    Logical Or(w27, $Stop) -> w28
    next s1 = w27
    stop if w28
  }
  call "niUSRP Close Session.gvi"(session handle=w25, error in=s1) -> (error out=w29)
  call "Simple Error Handler.gvi"(error in=w29)
  $"IQ Sampling Rate [S/sec] (actual)" <- w9
  $"Carrier Frequency [Hz] (actual)" <- w10
  $"Gain [dB] (actual)" <- w11
